# Grasshopper definition 201_robot_workspace_T3.ghx (Grasshopper 1.0.8)

pt = ConstructPoint(XCoordinate="100", YCoordinate="100", ZCoordinate=0)
rhino = Python3Script(origin=pt, square_size=Slider(80, range=75..100))  # -> out, my_way_planes; inputs origin: Point3d, square_size: Double
# ---------- rhino: Python ----------
import Rhino.Geometry as rg

def create_square_way_planes(origin, size):
    """
    Define a square with a point3d as origin and 
    size as a float for the width and length
    """
    # Calculate the coordinates for the four corners of the square
    x, y = origin.X, origin.Y

    # Define the four corners of the square
    corner1 = rg.Point3d(x - size / 2, y - size / 2, 0)
    corner2 = rg.Point3d(x + size / 2, y - size / 2, 0)
    corner3 = rg.Point3d(x + size / 2, y + size / 2, 0)
    corner4 = rg.Point3d(x - size / 2, y + size / 2, 0)
    
    # Make plane from corner points
    plane1 = rg.Plane(corner1, rg.Vector3d.XAxis, rg.Vector3d.YAxis)
    plane2 = rg.Plane(corner2, rg.Vector3d.XAxis, rg.Vector3d.YAxis)
    plane3 = rg.Plane(corner3, rg.Vector3d.XAxis, rg.Vector3d.YAxis)
    plane4 = rg.Plane(corner4, rg.Vector3d.XAxis, rg.Vector3d.YAxis)

    # Add the corners to the list of square planes
    square_planes = [plane1, plane2, plane3, plane4, plane1]

    # Return the list of square points
    return square_planes

my_way_planes = create_square_way_planes(origin, square_size)
# ---------- end rhino ----------
points = PointList(Points=rhino.my_way_planes, Size=10)

crv = Curve(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)
srf = Surface(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)
# Generate Planes
curve_to_planes__non_planar = Python3Script(C=crv, S=srf, point_spacing=Slider(120, range=0..600))  # -> out, my_way_planes; inputs C: Curve, S: Surface, point_spacing: Double
# ---------- curve_to_planes__non_planar: Python ----------
import Rhino.Geometry as rg
import math


def as_list(x):
    if x is None:
        return []
    return x if isinstance(x, (list, tuple)) else [x]


def divide_crv(crv, spacing):
    length = crv.GetLength()
    if length <= 0 or spacing <= 0:
        return []

    pts = []
    count = int(math.ceil(length / spacing))

    for i in range(count + 1):
        d = min(i * spacing, length)
        ok, t = crv.LengthParameter(d)
        if ok:
            pts.append(crv.PointAt(t))

    return pts


def safe_unit(v, fallback): # unitize vector
    v = rg.Vector3d(v)

    if v.Length < 0.001:
        v = rg.Vector3d(fallback)

    v.Unitize()
    return v


def get_xaxis(pts, i):
    if len(pts) < 2:
        return rg.Vector3d(1, 0, 0)

    if i == 0:
        xaxis = pts[1] - pts[0]
    else:
        xaxis = pts[i] - pts[i - 1]

    return safe_unit(xaxis, rg.Vector3d(1, 0, 0))


def make_planar_planes(pts, flip=False):
    planes = []

    for i, pt in enumerate(pts):
        xaxis = get_xaxis(pts, i)

        zaxis = rg.Vector3d(0, 0, 1)
        yaxis = rg.Vector3d.CrossProduct(zaxis, xaxis)
        yaxis = safe_unit(yaxis, rg.Vector3d(0, 1, 0))
        
        if flip:
            yaxis *= -1

        zaxis = rg.Vector3d.CrossProduct(xaxis, yaxis)
        zaxis = safe_unit(zaxis, rg.Vector3d(0, 0, 1))

        planes.append(rg.Plane(pt, xaxis, yaxis))

    return planes

def make_nonplanar_planes(pts, curve, surface, flip=False):
    planes = []

    for pt in pts:
        ok, t = curve.ClosestPoint(pt)
        xaxis = curve.TangentAt(t) if ok else rg.Vector3d(1, 0, 0)
        xaxis = safe_unit(xaxis, rg.Vector3d(1, 0, 0))

        ok, u, v = surface.ClosestPoint(pt)
        yaxis = surface.NormalAt(u, v) if ok else rg.Vector3d(0, 0, 1)
        yaxis = safe_unit(yaxis, rg.Vector3d(0, 0, 1))
        
        if flip:
            yaxis *= -1

        zaxis = rg.Vector3d.CrossProduct(xaxis, yaxis)
        zaxis = safe_unit(zaxis, rg.Vector3d(0, 1, 0))

        yaxis = rg.Vector3d.CrossProduct(zaxis, xaxis)
        yaxis = safe_unit(yaxis, rg.Vector3d(0, 0, 1))

        planes.append(rg.Plane(pt, xaxis, yaxis))

    return planes


nonplanar = False
my_way_planes = []

for crv in as_list(C):
    pts = divide_crv(crv, point_spacing)

    if nonplanar and S:
        my_way_planes.extend(make_nonplanar_planes(pts, C, S, flip=False)) # C: single curve
    else:
        my_way_planes.extend(make_planar_planes(pts, flip=True))
# ---------- end curve_to_planes__non_planar ----------
pln = Plane(curve_to_planes__non_planar.my_way_planes)

pln_2 = Plane(pln)
fine_adjust_z_mm = Slider(0.8, range=-5..10)
pt_2 = ConstructPoint(XCoordinate="535.90", YCoordinate="101.40", ZCoordinate="-9.39")
pt_3 = ConstructPoint(XCoordinate="246.86", YCoordinate="-314.78", ZCoordinate="-10.85")
# Transform from Rhino to Robot Space
pt_4 = ConstructPoint(XCoordinate="534.35", YCoordinate="-315.60", ZCoordinate="-9.96")
rhino_2 = Python3Script(way_planes=pln_2, wobj_origin=pt_4, wobj_xaxis=pt_2, wobj_xypoint=pt_3, z_safe_margin=fine_adjust_z_mm)  # -> out, transformed_planes; inputs way_planes: list of Plane, wobj_origin: Point3d, wobj_xaxis: Point3d, wobj_xypoint: Point3d, z_safe_margin: Double
# ---------- rhino_2: Python ----------
import Rhino.Geometry as rg
import math

#in this step we transform our way planes to robot space
#the rhino co-ordinate system is rather abstract in the physical world
#the robot base plane assumed the base frame of robot is the origin
#but rhino does not know that
#thus we transform things from our design space(Rhino World XY) to Robot Base Plane that we measure

def set_robot_base(origin, xaxis, xypoint):
    """
    set a base plane representing the robot working object plane
    """
    robot_base = rg.Plane(origin, xaxis - origin, xypoint - origin)
    print (robot_base)
    return (robot_base)

def rhino_to_robot_space(rhino_plane,robot_base_plane):
    """
    Transform the objects from Rhino world XY plane to robot work object plane
    """
    T_matrix = rg.Transform.PlaneToPlane(rg.Plane.WorldXY,robot_base_plane)
    robot_plane = rhino_plane.Clone()
    # Invert plane to face Z down
    # Transform Rotation(Double angleRadians,Vector3d rotationAxis,Point3d rotationCenter)
    R = rg.Transform.Rotation(math.pi, rhino_plane.XAxis, rhino_plane.Origin)
    robot_plane.Transform(R)
    robot_plane.Transform(T_matrix)
    return robot_plane

def set_z_safe_margin(planes_to_adjust, safety_margin):
    adjusted_way_planes = []
    for plane in planes_to_adjust:
        plane.OriginZ += safety_margin
        adjusted_way_planes.append(plane)
    return adjusted_way_planes

# ===== Robot base is set =====
robot_base =  set_robot_base(wobj_origin, wobj_xaxis, wobj_xypoint)

# ===== Set safety margin for Z height ======
safer_planes = set_z_safe_margin(way_planes, z_safe_margin)

# ===== Transforming the rhino planes into robot planes =====
transformed_planes = []
for plane in way_planes: 
    transformed_planes.append(rhino_to_robot_space(plane, robot_base))
# ---------- end rhino_2 ----------
points_2 = PointList(Points=rhino_2.transformed_planes, Size=10)
panel = Panel("tcp = [-0.120, 0.0, -0.4525, 0.0, 0.0, 0.0]")
number_slider = Slider(0.6, range=0..2)
number_slider_2 = Slider(0.2, range=0..1)
# Convert Planes to URScript
pt_5 = ConstructPoint(XCoordinate="0.07", YCoordinate="-0.06", ZCoordinate="74.33")
pt_6 = ConstructPoint(XCoordinate="-120", YCoordinate="0", ZCoordinate="-452.5")
rhino_3 = Python3Script(
    way_planes=rhino_2.transformed_planes,
    tcp_measured=pt_6,
    radius=Slider(6, range=0..20),
    acceleration=number_slider,
    velocity=number_slider_2)  # -> out, script; inputs way_planes: list of Plane, tcp_measured: Point3d, radius: Double, acceleration: Double, velocity: Double
# ---------- rhino_3: Python ----------
from imp import reload
import sys

sys.path.append("C:\\Users\\user\\github\\F3DP\\01 tamplate\\02_RoboticDrawing\\src")

import simple_ur_script as ur
reload(ur)

import utils 
reload(utils)

import simple_comm as com
reload(com)

import Rhino.Geometry as rg
import math as m

script = "" #create empty string

#if value given for tcp measured, then add line to script, otherwise it will take current tcp from robot
if tcp_measured is not None:
    script += ur.set_tcp_by_angles(tcp_measured.X, tcp_measured.Y, tcp_measured.Z, m.radians(0.0),m.radians(0.0),m.radians(0))

#calculate blend
blend_radii = utils.calculate_blend_radius(way_planes, radius=radius)
#add move_l commands to script for each way plane
for plane, radius in zip(way_planes, blend_radii):
    script += ur.move_l_blend(plane, acceleration, velocity, radius)


#format the script to make it sendable
script = com.concatenate_script(script)
# ---------- end rhino_3 ----------

# ---- group: Send UR script to Robot!
py3 = Python3Script(script=rhino_3.script, ip_address="192.168.10.10", send=Button())  # -> out, a; inputs script: String, ip_address: String, send: Boolean
# ---------- py3: Python ----------
import simple_comm as com

if send:
    com.send_script(script,ip_address)
# ---------- end py3 ----------

# ----
# Send to Robot!
panel_2 = Panel(rhino_3.script)
