# Grasshopper definition 0630_print test 01_nonplanar bridging.gh (Grasshopper 1.0.8)
# plug-ins: MeshEdit Components, treesloth01, Pufferfish, Increment, LunchBox, Mesh Pipe

# ---- group: Printing bed
pt = Point(Point(1.46383428e-07, -395.2788595, -24.31783007))
pdecon = Deconstruct(Point=pt)  # -> XComponent, YComponent, ZComponent
division = Division(A="1500", B="2")
division_2 = Division(A="1000", B="2")
division_3 = Division(A="50", B="2")
neg = Negative(Value=division_3)
pt_2 = ConstructPoint(XCoordinate=pdecon.XComponent, YCoordinate=pdecon.YComponent, ZCoordinate=neg)
box = CenterBox(Base=pt_2, X=division, Y=division_2, Z=division_3)

# ---- group: Cantilever
py3 = Python3Script(
    layer_z="0.0",
    line_spacing=Slider(20, range=0..100),
    bed_line_count=Slider(4, range=0..10),
    bed_line_length=Slider(300, range=0..1000),
    vertical_line_count=Slider(6, range=0..100),
    vertical_height=Slider(200, range=0..1000),
    vertical_height_step=Slider(50, range=0..100),
    cantilever_line_count=Slider(10, range=0..10),
    cantilever_length=Slider(100, range=0..1000),
    cantilever_length_step=Slider(50, range=0..100))  # -> out, points, polyline, segments; inputs layer_z: Double, line_spacing: Double, bed_line_count: Int32, bed_line_length: Double, vertical_line_count: Int32, vertical_height: Double, vertical_height_step: Double, cantilever_line_count: Int32, cantilever_length: Double, cantilever_length_step: Double
# ---------- py3: Python ----------
import Rhino.Geometry as rg

# ------------------------------------------------------------
# Helper functions
# ------------------------------------------------------------

def add_ordered_points(toolpath_pts, pts, reverse=False, tolerance=0.001):
    """
    Add points to toolpath.
    If reverse is True, the point order is reversed.
    The first point is only added if it is not already the current last point.
    """

    if reverse:
        pts = pts[::-1]

    if len(toolpath_pts) == 0:
        toolpath_pts.extend(pts)
    else:
        if toolpath_pts[-1].DistanceTo(pts[0]) > tolerance:
            toolpath_pts.append(pts[0])

        toolpath_pts.extend(pts[1:])


# ------------------------------------------------------------
# 1. Generate bed lines
# ------------------------------------------------------------

toolpath_pts = []

for i in range(bed_line_count):

    x = -i * line_spacing

    p0 = rg.Point3d(x, 0, layer_z)
    p1 = rg.Point3d(x, -bed_line_length, layer_z)

    add_ordered_points(
        toolpath_pts,
        [p0, p1],
        reverse=(i % 2 != 0),
    )


# ------------------------------------------------------------
# 2. Generate vertical / perpendicular lines after bed lines
# ------------------------------------------------------------

start_pt = toolpath_pts[-1]

start_x = start_pt.X
start_y = start_pt.Y
start_z = start_pt.Z

for j in range(vertical_line_count):

    x = start_x - j * line_spacing
    height_offset = (j // 2) * vertical_height_step

    base_pt = rg.Point3d(x, start_y, start_z)
    top_pt = rg.Point3d(x, start_y, start_z + vertical_height + height_offset)

    add_ordered_points(
        toolpath_pts,
        [base_pt, top_pt],
        reverse=(j % 2 != 0),
    )


# ------------------------------------------------------------
# 3. Generate vertical + cantilever lines
# ------------------------------------------------------------

previous_pt = toolpath_pts[-1]

start_pt = rg.Point3d(
    previous_pt.X - line_spacing,
    previous_pt.Y,
    previous_pt.Z
)

add_ordered_points(
    toolpath_pts,
    [start_pt],
    reverse=False,
)

start_x = start_pt.X
start_y = start_pt.Y
start_z = start_pt.Z

for k in range(cantilever_line_count):

    x = start_x - k * line_spacing
    current_cantilever_length = cantilever_length + (k // 2) * cantilever_length_step

    base_pt = rg.Point3d(x, start_y, start_z)
    top_pt = rg.Point3d(x, start_y, start_z + vertical_height)
    cantilever_pt = rg.Point3d(
        top_pt.X,
        top_pt.Y - current_cantilever_length,
        top_pt.Z
    )

    add_ordered_points(
        toolpath_pts,
        [base_pt, top_pt, cantilever_pt],
        reverse=(k % 2 != 0),
    )


# ------------------------------------------------------------
# 4. Create final polyline and curve segments
# ------------------------------------------------------------

points = toolpath_pts
polyline = rg.Polyline(toolpath_pts)

segments = []
for i in range(len(toolpath_pts) - 1):
    segments.append(rg.LineCurve(toolpath_pts[i], toolpath_pts[i + 1]))
# ---------- end py3 ----------
geo = Geometry(py3.polyline)

# ---- group: Overhang angle
py3_2 = Python3Script(
    layer_z="0.0",
    line_spacing=Slider(20, range=0..100),
    bed_line_count=Slider(4, range=0..10),
    bed_line_length=Slider(300, range=0..1000),
    vertical_line_count=Slider(6, range=0..10),
    vertical_height=Slider(200, range=0..1000),
    vertical_height_step=Slider(50, range=0..100),
    overhang_line_count=Slider(39, range=0..100),
    overhang_length=Slider(100, range=0..1000),
    overhang_length_step=Slider(50, range=0..100),
    angle_step=Slider(15, range=0..100))  # -> out, points, polyline, segments; inputs layer_z: Double, line_spacing: Double, bed_line_count: Int32, bed_line_length: Double, vertical_line_count: Int32, vertical_height: Double, vertical_height_step: Double, overhang_line_count: Int32, overhang_length: Double, overhang_length_step: Double, angle_step: Int32
# ---------- py3_2: Python ----------
import Rhino.Geometry as rg
import math


# ------------------------------------------------------------
# Helper functions
# ------------------------------------------------------------

def add_ordered_points(toolpath_pts, pts, reverse=False, tolerance=0.001):
    """
    Add a list of points to the toolpath.

    If reverse is True, the point order is reversed.
    The first point is only added when it is not already
    """

    if reverse:
        pts = pts[::-1]

    if len(toolpath_pts) == 0:
        toolpath_pts.extend(pts)
        return

    if toolpath_pts[-1].DistanceTo(pts[0]) > tolerance:
        toolpath_pts.append(pts[0])

    toolpath_pts.extend(pts[1:])


def point_from_angle_distance(start_pt, angle_deg, distance):
    angle_rad = math.radians(angle_deg)

    vec = rg.Vector3d.ZAxis
    vec.Rotate(angle_rad, rg.Vector3d.XAxis)
    vec.Unitize()

    return start_pt + vec * distance


# ------------------------------------------------------------
# 1. Generate bed lines
# ------------------------------------------------------------

toolpath_pts = []

for i in range(int(bed_line_count)):

    x = -i * line_spacing

    bed_start_pt = rg.Point3d(x, 0, layer_z)
    bed_end_pt = rg.Point3d(x, -bed_line_length, layer_z)

    add_ordered_points(
        toolpath_pts,
        [bed_start_pt, bed_end_pt],
        reverse=(i % 2 != 0)
    )


# ------------------------------------------------------------
# 2. Generate vertical + angled overhang test lines
# ------------------------------------------------------------

previous_pt = toolpath_pts[-1]

start_pt = rg.Point3d(
    previous_pt.X - line_spacing,
    previous_pt.Y,
    previous_pt.Z
)

add_ordered_points(toolpath_pts, [start_pt])

start_x = start_pt.X
start_y = start_pt.Y
start_z = start_pt.Z


overhang_angles = list(range(15, 180, angle_step))
# overhang_angles = [
#     angle_start + i * angle_step
#     for i in range(angle_count)
# ]

angles_per_length = len(overhang_angles)


# Offset direction for the return path
return_offset_vec = rg.Vector3d(line_spacing, 0, 0)


for test_id in range(overhang_line_count):

    # --------------------------------------------------------
    # Determine angle and length group
    # --------------------------------------------------------

    angle_index = test_id % angles_per_length
    length_group_id = test_id // angles_per_length

    angle_deg = overhang_angles[angle_index]

    test_length = overhang_length + length_group_id * overhang_length_step


    # --------------------------------------------------------
    # Generate base, top, and angled overhang points
    # --------------------------------------------------------

    x = start_x - test_id * line_spacing * 2

    base_pt = rg.Point3d(
        x,
        start_y,
        start_z
    )

    top_pt = rg.Point3d(
        x,
        start_y,
        start_z + vertical_height
    )

    overhang_end_pt = point_from_angle_distance(top_pt, angle_deg, test_length)


    # --------------------------------------------------------
    # Generate offset return points
    # --------------------------------------------------------

    offset_base_pt = base_pt - return_offset_vec
    offset_top_pt = top_pt - return_offset_vec
    offset_overhang_end_pt = overhang_end_pt - return_offset_vec


    # --------------------------------------------------------
    # base → top → overhang end
    #      → offset overhang end → offset top → offset base
    # --------------------------------------------------------

    test_pts = [
        base_pt,
        top_pt,
        overhang_end_pt,
        offset_overhang_end_pt,
        offset_top_pt,
        offset_base_pt
    ]

    add_ordered_points(
        toolpath_pts,
        test_pts,
        reverse=(test_id % 2 != 0)
    )


# ------------------------------------------------------------
# 3. Create final polyline and curve segments
# ------------------------------------------------------------

points = toolpath_pts
polyline = rg.Polyline(toolpath_pts)

segments = []
for i in range(len(toolpath_pts) - 1):
    segments.append(rg.LineCurve(toolpath_pts[i], toolpath_pts[i + 1])) # curve version of the lines
# ---------- end py3_2 ----------
geo_2 = Geometry(py3_2.points)
geo_3 = Geometry(py3_2.polyline)

# ---- group: Non-planar_a
number_slider = Slider(12, range=0..100)  # disabled
panel = Panel("0 to 1")  # disabled
number_slider_2 = Slider(30, range=0..500)  # disabled
number_slider_3 = Slider(120, range=0..1000)  # disabled
range = Range(Domain=panel, Steps=expr("x-1", number_slider))  # disabled
graph = GraphMapper(range, x0=0, x1=1, y0=0, y1=1, container_name="Sine", Equation_px=[0, 0.2509106696], Equation_py=[0, 1])  # disabled
dom = ConstructDomain(DomainStart=number_slider_2, DomainEnd=number_slider_3)  # disabled
remap = RemapNumbers(Value=graph, Source=panel, Target=dom)  # -> Mapped, Clipped; disabled
dispatch = Dispatch(List=remap.Mapped, DispatchPattern=[True, False])  # -> ListA, ListB; disabled

# ---- group: Non-planar_b_linear
X = UnitX(Factor=1)
line = LineSDL(Start="{0,0,0}", Direction=X, Length=Slider(600, range=0..1000))
number_slider_4 = Slider(100, range=0..200)
divide = DivideCurve(Curve=line, Count=Slider(10, range=0..30), Kinks=False)  # -> Points, Tangents, Parameters
lng = ListLength(List=divide.Points)
range_2 = Range(Domain="0 to 1", Steps=expr("x-1", lng))
dom_2 = ConstructDomain(DomainStart=number_slider_4, DomainEnd=Slider(250, range=0..500))
remap_2 = RemapNumbers(Value=range_2, Source="0 to 1", Target=dom_2)  # -> Mapped, Clipped
Z = UnitZ(Factor=remap_2.Mapped)
move = Move(Geometry=divide.Points, Motion=Z)  # -> Geometry, Transform
dispatch_2 = Dispatch(List=move.Geometry, DispatchPattern=[True, False])  # -> ListA, ListB
pdecon_2 = Deconstruct(Point=dispatch_2.ListA)  # -> XComponent, YComponent, ZComponent
item = ListItem(List=pdecon_2.ZComponent, Index=0, Wrap=True)
bead_height = Slider(10, range=0..50)
pt_3 = ConstructPoint(XCoordinate=pdecon_2.XComponent, YCoordinate=pdecon_2.YComponent, ZCoordinate=item)
weave = Weave(Pattern=[0, 1], Stream0=pt_3, Stream1=dispatch_2.ListB, NullGaps=False)
intcrv = Interpolate(Vertices=weave, Degree=3, Periodic=False, KnotStyle=1)  # -> Curve, Length, Domain
division_4 = Division(A=number_slider_4, B=bead_height)
range_3 = Range(Domain=Domain(0, 1), Steps=division_4)
rulesrf = RuledSurface(CurveA=line, CurveB=intcrv.Curve)
tweencrv = TweenCurve(CurveA=line, CurveB=intcrv.Curve, Factor=range_3, BlendType=0)

# ---- group: Bridge span_same level
X_2 = UnitX(Factor=1)
line_2 = LineSDL(Start="{0,0,0}", Direction=X_2, Length=Slider(400, range=0..1000))
rotate = Rotate(Geometry=line_2, Angle=degrees(Slider(90, range=0..180)), Plane=PlaneXY(0, 0, 0))  # -> Geometry, Transform
height = Slider(200, range=0..1000)
join = JoinCurves(Curves=[line_2, rotate.Geometry], Preserve=False)
Z_2 = UnitZ(Factor=height)
number_slider_5 = Slider(10, range=0..30)
extr = Extrude(Base=join, Direction=Z_2)
contour = Contour(Shape=extr, Point="{0,0,0}", Direction=Vector(0, 0, 1), Distance=number_slider_5)  # -> flatten(Contours)

# ---- group: Non-planar_b_loop
number_slider_6 = Slider(12, range=0..100)
range_4 = Range(Domain="0 to 1", Steps=expr("x-1", number_slider_6))
dom_3 = ConstructDomain(DomainStart=Slider(30, range=0..500), DomainEnd=Slider(120, range=0..1000))
remap_3 = RemapNumbers(Value=range_4, Source="0 to 1", Target=dom_3)  # -> Mapped, Clipped
dispatch_3 = Dispatch(List=remap_3.Mapped, DispatchPattern=[True, False])  # -> ListA, ListB
peak_height = Panel(dispatch_3.ListA)

# ---- group: Bridge span_different level
X_3 = UnitX(Factor=1)
line_3 = LineSDL(Start="{0,0,0}", Direction=X_3, Length=Slider(400, range=0..1000))
rotate_2 = Rotate(Geometry=line_3, Angle=degrees(Slider(90, range=0..180)), Plane=PlaneXY(0, 0, 0))  # -> Geometry, Transform
height_2 = Slider(200, range=0..1000)
multiplication = Multiplication(A=height_2, B=Slider(2, range=0..10))
Z_3 = UnitZ(Factor=multiplication)
Z_4 = UnitZ(Factor=height_2)
number_slider_7 = Slider(10, range=0..30)
extr_2 = Extrude(Base=line_3, Direction=Z_3)
extr_3 = Extrude(Base=rotate_2.Geometry, Direction=Z_4)
join_2 = BrepJoin(Breps=[extr_2, extr_3])  # -> Breps, Closed
contour_2 = Contour(Shape=join_2.Breps, Point="{0,0,0}", Direction=Vector(0, 0, 1), Distance=number_slider_7)  # -> flatten(Contours)
move_2 = Move(Geometry=rotate_2.Geometry, Motion=Z_4)  # -> Geometry, Transform
Z_5 = UnitZ(Factor=number_slider_7)
cull_i = CullIndex(List=contour_2, Indices="-1", Wrap=True)
move_3 = Move(Geometry=move_2.Geometry, Motion=Z_5)  # -> Geometry, Transform
item_2 = ListItem(List=contour_2, Index="-1", Wrap=True)

len = Length(Curve=cull_i)
sort = SortList(Keys=len, ValuesA=cull_i)  # -> Keys, ValuesA
item_3 = ListItem(List=sort.Keys, Index=0, Wrap=True)
smaller = SmallerThan(FirstNumber=cull_i, SecondNumber=expr("x+1", item_3))  # -> SmallerThan, OrEqualTo
dispatch_4 = Dispatch(List=cull_i, DispatchPattern=smaller.OrEqualTo)  # -> ListA, ListB
crv = Curve(dispatch_4.ListA)
flip = FlipCurve(Curve=crv)  # -> Curve, Flag
weave_2 = Weave(Pattern=smaller.OrEqualTo, Stream0=dispatch_4.ListB, Stream1=flip.Curve, NullGaps=False)

# ---- group: Non-planar_b_loop
panel_2 = Panel("{0,0,0}")

cir = Circle(Plane=panel_2, Radius=Slider(200, range=0..1000))
ptdivcrvsegs = PointDivideCurveSegments(Curve=cir, Number=number_slider_6, EndPoint=False)  # -> Points, Tangents, Parameters
dispatch_5 = Dispatch(List=ptdivcrvsegs.Points, DispatchPattern=[True, False])  # -> ListA, ListB
Z_6 = UnitZ(Factor=dispatch_3.ListA)
move_4 = Move(Geometry=dispatch_5.ListA, Motion=Z_6)  # -> Geometry, Transform
weave_3 = Weave(Pattern=[0, 1], Stream0=move_4.Geometry, Stream1=dispatch_5.ListB, NullGaps=False)
intcrv_2 = Interpolate(Vertices=weave_3, Degree=3, Periodic=invert(False), KnotStyle=1)  # -> Curve, Length, Domain

# ---- group: Bridge span_same level
dispatch_6 = Dispatch(List=contour, DispatchPattern=[True, False])  # -> ListA, ListB
flip_2 = FlipCurve(Curve=dispatch_6.ListB)  # -> Curve, Flag
weave_4 = Weave(Pattern=[0, 1], Stream0=dispatch_6.ListA, Stream1=flip_2.Curve, NullGaps=False)
end = EndPoints(Curve=weave_4)  # -> Start, End
cull_i_2 = CullIndex(List=end.Start, Indices="0", Wrap=True)
cull_i_3 = CullIndex(List=end.End, Indices="-1", Wrap=True)
ln = Line(StartPoint=cull_i_3, EndPoint=cull_i_2)
merge = Merge(Data1=weave_4, Data2=ln)  # -> flatten(Result)
join_3 = JoinCurves(Curves=merge, Preserve=False)
end_2 = EndPoints(Curve=join_3)  # -> Start, End

item_4 = ListItem(List=contour, Index=0, Wrap=True)  # -> Item1, Item
Z_7 = UnitZ(Factor=number_slider_5)
move_5 = Move(Geometry=item_4.Item1, Motion=Z_7)  # -> Geometry, Transform
explode = Explode(Curve=move_5.Geometry, Recursive=True)  # -> Segments, Vertices
item_5 = ListItem(List=explode.Segments, Index=0, Wrap=True)  # -> Item, Item1
flip_3 = FlipCurve(Curve=item_5.Item)  # -> Curve, Flag
stack = StackTrees(Data0=flip_3.Curve, Data1=item_5.Item1, Reduce=True)
divlength = DivideLength(Curve=stack, Length=Slider(40, range=0..100))  # -> Points, Tangents, Parameters
cull_i_4 = CullIndex(List=divlength.Points, Indices="0", Wrap=True)
bang = ExplodeTree(Data=cull_i_4)  # -> Branch0, Branch1
ln_2 = Line(StartPoint=bang.Branch0, EndPoint=bang.Branch1)
len_2 = Length(Curve=ln_2)
length = Panel(len_2)

# ---- group: Bridge span_different level
dispatch_7 = Dispatch(List=weave_2, DispatchPattern=[True, False])  # -> ListA, ListB
flip_4 = FlipCurve(Curve=dispatch_7.ListB)  # -> Curve, Flag
weave_5 = Weave(Pattern=[0, 1], Stream0=dispatch_7.ListA, Stream1=flip_4.Curve, NullGaps=False)
end_3 = EndPoints(Curve=weave_5)  # -> Start, End
cull_i_5 = CullIndex(List=end_3.Start, Indices="0", Wrap=True)
cull_i_6 = CullIndex(List=end_3.End, Indices="-1", Wrap=True)
ln_3 = Line(StartPoint=cull_i_6, EndPoint=cull_i_5)
merge_2 = Merge(Data1=weave_5, Data2=ln_3)  # -> flatten(Result)
join_4 = JoinCurves(Curves=merge_2, Preserve=False)
end_4 = EndPoints(Curve=join_4)  # -> Start, End

# ---- group: Non-planar_b_loop / bead height
number_slider_8 = Slider(10, range=0..100)

# ---- group: Non-planar_b_loop
number_slider_9 = Slider(300, range=0..1000)
division_5 = Division(A=number_slider_9, B=number_slider_8)
Z_8 = UnitZ(Factor=number_slider_9)
round = Round(Number=division_5)  # -> Nearest, Floor, Ceiling
move_6 = Move(Geometry=intcrv_2.Curve, Motion=Z_8)  # -> Geometry, Transform
range_5 = Range(Domain=Domain(0, 1), Steps=expr("x-1", round.Ceiling))
rulesrf_2 = RuledSurface(CurveA=cir, CurveB=move_6.Geometry)
tweencrv_2 = TweenCurve(CurveA=cir, CurveB=move_6.Geometry, Factor=range_5, BlendType=0)

# ---- group: Bridge span_different level
flip_5 = FlipCurve(Curve=move_3.Geometry)  # -> Curve, Flag
stack_2 = StackTrees(Data0=item_2, Data1=flip_5.Curve, Reduce=True)
divlength_2 = DivideLength(Curve=stack_2, Length=Slider(40, range=0..100))  # -> Points, Tangents, Parameters
cull_i_7 = CullIndex(List=divlength_2.Points, Indices="-1", Wrap=True)
bang_2 = ExplodeTree(Data=cull_i_7)  # -> Branch0, Branch1
ln_4 = Line(StartPoint=bang_2.Branch0, EndPoint=bang_2.Branch1)
len_3 = Length(Curve=ln_4)
length_2 = Panel(len_3)

# ---- group: Non-planar_b_loop / interval checking
dam = DataDam(DataA=tweencrv_2, BufferDelay=10000000, BufferMode=0)
range_6 = Range(Domain=Domain(0, 1), Steps=Slider(30, range=0..50))
eval = EvaluateCurve(Curve=reparameterize(graft(dam)), Parameter=range_6)  # -> flatten(Point), Tangent, Angle
sort_pts = SortDuplicatePoints(Points=eval.Point)  # -> UniquePoints, Indices
lng_2 = ListLength(List=flatten(sort_pts.UniquePoints))
series = Series(Start=0, Step=1, Count=lng_2)
flatten = FlattenTree(Tree=sort_pts.UniquePoints, Path="{0}")
cull_i_8 = CullIndex(List=flatten, Indices=simplify(graft(series)), Wrap=True)  # -> simplify(List)
cp = ClosestPoint(Point=simplify(graft(flatten)), Cloud=simplify(cull_i_8))  # -> flatten(ClosestPoint), CPIndex, Distance
dist = Distance(PointA=flatten, PointB=cp.ClosestPoint)  # -> flatten(Distance)
ln_5 = Line(StartPoint=flatten, EndPoint=cp.ClosestPoint)  # -> flatten(Line)
sort_2 = SortList(Keys=flatten(dist), ValuesA=flatten(ln_5))  # -> Keys, ValuesA
first_last = FirstLast(List=sort_2.Keys)  # -> FirstValue, LastValue
panel_3 = Panel(first_last.FirstValue)
panel_4 = Panel(first_last.LastValue)
mindex = MemberIndex(Set=sort_2.Keys, Member=first_last.FirstValue)  # -> Index, Count
mindex_2 = MemberIndex(Set=sort_2.Keys, Member=first_last.LastValue)  # -> Index, Count
item_6 = ListItem(List=sort_2.ValuesA, Index=[mindex.Index, mindex_2.Index], Wrap=True)
crv_2 = Curve(item_6)

# ---- group: Non-planar_b_linear / interval checking
dam_2 = DataDam(DataA=tweencrv, BufferDelay=10000000, BufferMode=0)
range_7 = Range(Domain=Domain(0, 1), Steps=Slider(30, range=0..50))
eval_2 = EvaluateCurve(Curve=reparameterize(graft(dam_2)), Parameter=range_7)  # -> flatten(Point), Tangent, Angle
sort_pts_2 = SortDuplicatePoints(Points=eval_2.Point)  # -> UniquePoints, Indices
lng_3 = ListLength(List=flatten(sort_pts_2.UniquePoints))
series_2 = Series(Start=0, Step=1, Count=lng_3)
flatten_2 = FlattenTree(Tree=sort_pts_2.UniquePoints, Path="{0}")
cull_i_9 = CullIndex(List=flatten_2, Indices=simplify(graft(series_2)), Wrap=True)  # -> simplify(List)
cp_2 = ClosestPoint(Point=simplify(graft(flatten_2)), Cloud=simplify(cull_i_9))  # -> flatten(ClosestPoint), CPIndex, Distance
dist_2 = Distance(PointA=flatten_2, PointB=cp_2.ClosestPoint)  # -> flatten(Distance)
ln_6 = Line(StartPoint=flatten_2, EndPoint=cp_2.ClosestPoint)  # -> flatten(Line)
sort_3 = SortList(Keys=flatten(dist_2), ValuesA=flatten(ln_6))  # -> Keys, ValuesA
first_last_2 = FirstLast(List=sort_3.Keys)  # -> FirstValue, LastValue
panel_5 = Panel(first_last_2.FirstValue)
panel_6 = Panel(first_last_2.LastValue)
mindex_3 = MemberIndex(Set=sort_3.Keys, Member=first_last_2.FirstValue)  # -> Index, Count
mindex_4 = MemberIndex(Set=sort_3.Keys, Member=first_last_2.LastValue)  # -> Index, Count
item_7 = ListItem(List=sort_3.ValuesA, Index=[mindex_3.Index, mindex_4.Index], Wrap=True)
crv_3 = Curve(item_7)

# ---- group: Non-planar_a
number_slider_10 = Slider(1, range=0..10)  # disabled
panel_7 = Panel("360")  # disabled
division_6 = Division(A=panel_7, B=number_slider)  # disabled
multiplication_2 = Multiplication(A=division_6, B=number_slider_10)  # disabled

number_slider_11 = Slider(1, range=0..10)  # disabled
panel_8 = Panel("360")  # disabled
division_7 = Division(A=panel_8, B=number_slider)  # disabled
multiplication_3 = Multiplication(A=division_7, B=number_slider_11)  # disabled

# ---- group: Non-planar_b_loop / continuous toolpath
neg_2 = Negative(Value=Slider(20, range=0..100))
ext = ExtendCurve(Curve=tweencrv_2, Type=0, Start=Slider(0, range=0..10), End=neg_2)
end_5 = EndPoints(Curve=ext)  # -> Start, End
shift = ShiftList(List=end_5.Start, Shift=1, Wrap=invert(True))
cull_i_10 = CullIndex(List=end_5.End, Indices="-1", Wrap=True)
ln_7 = Line(StartPoint=cull_i_10, EndPoint=shift)
tail_length = Slider(300, range=0..1000)
join_5 = JoinCurves(Curves=flatten([ext, ln_7]), Preserve=False)
end_6 = EndPoints(Curve=join_5)  # -> Start, End
X_4 = UnitX(Factor=1)
line_4 = LineSDL(Start=end_6.Start, Direction=X_4, Length=tail_length)
join_6 = JoinCurves(Curves=[line_4, join_5], Preserve=False)
flip_6 = FlipCurve(Curve=join_6)  # -> Curve, Flag
curvepoint = PointOnCurve(flip_6.Curve, parameter=0.124)
crv_nonplanar = Curve(flip_6.Curve)
mpipe = MeshPipe(Curve=crv_nonplanar, Radius=Slider(5, range=0..10), Accuracy=0.2, Rotation=0, Segments=10, Caps=2)

# ---- group: Non-planar_b_linear
dispatch_8 = Dispatch(List=tweencrv, DispatchPattern=[True, False])  # -> ListA, ListB
flip_7 = FlipCurve(Curve=dispatch_8.ListB)  # -> Curve, Flag
weave_6 = Weave(Pattern=[0, 1], Stream0=dispatch_8.ListA, Stream1=flip_7.Curve, NullGaps=False)
end_7 = EndPoints(Curve=weave_6)  # -> Start, End
cull_i_11 = CullIndex(List=end_7.Start, Indices="0", Wrap=True)
cull_i_12 = CullIndex(List=end_7.End, Indices="-1", Wrap=True)
item_8 = ListItem(List=end_7.End, Index="-1", Wrap=True)
item_9 = ListItem(List=end_7.Start, Index="0", Wrap=True)
Y = UnitY(Factor=1)
Z_9 = UnitZ(Factor=1)
line_5 = LineSDL(Start=item_9, Direction=Y, Length=Slider(300, range=0..1000))
ln_8 = Line(StartPoint=cull_i_12, EndPoint=cull_i_11)
line_6 = LineSDL(Start=item_8, Direction=Z_9, Length=Slider(30, range=0..1000))
merge_3 = Merge(Data1=line_5, Data2=weave_6, Data3=ln_8, Data4=line_6)
join_7 = JoinCurves(Curves=flatten(merge_3), Preserve=False)
crv_nonplanar_2 = Curve(join_7)

# ---- group: Bridge span_same level
end_8 = EndPoints(Curve=ln_2)  # -> reverse(Start), reverse(End)
panel_9 = Panel("""0
-1""")
cull_i_13 = CullIndex(List=end_8.Start, Indices=panel_9, Wrap=True)
dispatch_9 = Dispatch(List=end_8.End, DispatchPattern=[True, False])  # -> ListA, ListB
dispatch_10 = Dispatch(List=cull_i_13, DispatchPattern=[True, False])  # -> ListA, ListB
ln_9 = Line(StartPoint=dispatch_9.ListA, EndPoint=dispatch_9.ListB)
ln_10 = Line(StartPoint=dispatch_10.ListA, EndPoint=dispatch_10.ListB)
merge_4 = Merge(Data1=ln_2, Data2=ln_9, Data3=ln_10)  # -> flatten(Result)
entry_length = Slider(300, range=0..1000)
tail_length_2 = Slider(30, range=0..100)
join_8 = JoinCurves(Curves=merge_4, Preserve=False)
X_5 = UnitX(Factor=1)
end_9 = EndPoints(Curve=join_8)  # -> Start, End
Z_10 = UnitZ(Factor=1)
pt_4 = Point(end_2.Start)
line_7 = LineSDL(Start=pt_4, Direction=X_5, Length=entry_length)
ln_11 = Line(StartPoint=end_2.End, EndPoint=end_9.Start)
line_8 = LineSDL(Start=end_9.End, Direction=Z_10, Length=tail_length_2)
merge_5 = Merge(Data1=line_7, Data2=join_3, Data3=ln_11, Data4=join_8, Data5=line_8)  # -> flatten(Result)
join_9 = JoinCurves(Curves=merge_5, Preserve=False)

# ---- group: Bridge span_different level
end_10 = EndPoints(Curve=ln_4)  # -> reverse(Start), reverse(End)
panel_10 = Panel("""0
-1""")
cull_i_14 = CullIndex(List=end_10.Start, Indices=panel_10, Wrap=True)
dispatch_11 = Dispatch(List=end_10.End, DispatchPattern=[True, False])  # -> ListA, ListB
dispatch_12 = Dispatch(List=cull_i_14, DispatchPattern=[True, False])  # -> ListA, ListB
ln_12 = Line(StartPoint=dispatch_11.ListA, EndPoint=dispatch_11.ListB)
ln_13 = Line(StartPoint=dispatch_12.ListA, EndPoint=dispatch_12.ListB)
merge_6 = Merge(Data1=ln_4, Data2=ln_12, Data3=ln_13)  # -> flatten(Result)
entry_length_2 = Slider(300, range=0..1000)
tail_length_3 = Slider(30, range=0..100)
join_10 = JoinCurves(Curves=merge_6, Preserve=False)
X_6 = UnitX(Factor=1)
end_11 = EndPoints(Curve=join_10)  # -> Start, End
Z_11 = UnitZ(Factor=1)
pt_5 = Point(end_4.Start)
line_9 = LineSDL(Start=pt_5, Direction=X_6, Length=entry_length_2)
ln_14 = Line(StartPoint=end_4.End, EndPoint=end_11.End)
line_10 = LineSDL(Start=end_11.Start, Direction=Z_11, Length=tail_length_3)
crv_4 = Curve(join_4)
merge_7 = Merge(Data1=line_9, Data2=crv_4, Data3=ln_14, Data4=join_10, Data5=line_10)  # -> flatten(Result)
join_11 = JoinCurves(Curves=merge_7, Preserve=False)

# ---- group: Non-planar_a / bead height
number_slider_12 = Slider(10, range=0..100)  # disabled

# ---- group: send to UR robot
print_pt = Point(Point(1.463969284e-07, -595.2788595, 0.6821699273))
number_slider_13 = Slider(10000, range=0..20000)
X_7 = UnitX(Factor=1)
Y_2 = UnitY(Factor=1)
panel_11 = Panel("{0,0,0}")
pl = ConstructPlane(Origin=print_pt, XAxis=X_7, YAxis=Y_2)
py3_3 = Python3Script(
    C=join_9,
    print_plane=pl,
    point_spacing=Slider(20, range=0..100),
    layer_height=Slider(10, range=0..50),
    speed_mm_min=number_slider_13,
    accel=Slider(0.3, range=0..1),
    blend_radius=Slider(2, range=0..10),
    delay_before=Slider(0.5, range=0..1),
    delay_after=Slider(0.5, range=0..1),
    digital_out=Slider(0, range=0..10))  # -> out, URScript, Planes, Points; inputs C: Curve, print_plane: Plane, point_spacing: Double, layer_height: Double, speed_mm_min: Double, accel: Double, blend_radius: Double, delay_before: Double, delay_after: Double, digital_out: Int32
# ---------- py3_3: Python ----------
import Rhino.Geometry as rg
import math


# ============================================================
# Inputs expected from Grasshopper
# ============================================================
# C               : Curve or list of Curves
# print_plane     : Plane
# point_spacing   : float, mm
# layer_height    : float, mm
# speed_mm_min    : float, mm/min
# accel           : float, m/s^2
# blend_radius    : float, mm
# delay_before    : float, sec
# delay_after     : float, sec
# digital_out     : int
#
# Outputs:
# URScript
# Planes
# Points


# ============================================================
# Default values
# ============================================================

if point_spacing is None:
    point_spacing = 10.0

if layer_height is None:
    layer_height = 10.0

if speed_mm_min is None:
    speed_mm_min = 10000.0

if accel is None:
    accel = 0.3

if blend_radius is None:
    blend_radius = 2.0

if delay_before is None:
    delay_before = 0.5

if delay_after is None:
    delay_after = 0.5

if digital_out is None:
    digital_out = 0

if print_plane is None:
    print_plane = rg.Plane.WorldXY


# ============================================================
# F3DP / UR10 settings
# ============================================================

# Robot speed:
# URScript uses meter / second.
# Given speed = 10000 mm / min.
speed_m_s = speed_mm_min / 1000.0 / 60.0

# Blend radius:
# URScript uses meter.
blend_radius_m = blend_radius / 1000.0

# Nozzle TCP offset from robot flange.
# Given:
# flange to nozzle = -Z 452.5 mm, -Y 122.5 mm
#
# URScript set_tcp uses meters.
tcp_x = 0.0
tcp_y = -122.5 / 1000.0
tcp_z = -452.5 / 1000.0

# TCP orientation relative to flange.
# Keep zero unless you have calibrated a rotated TCP.
tcp_rx = 0.0
tcp_ry = 0.0
tcp_rz = 0.0

# Approach / lift height
# Use layer_height as a conservative vertical approach offset.
approach_height = max(layer_height, 20.0)


# ============================================================
# Helper functions
# ============================================================

def ensure_curve_list(curves):
    if curves is None:
        return []

    if isinstance(curves, list) or isinstance(curves, tuple):
        return [crv for crv in curves if crv is not None]

    return [curves]


def sample_curve_by_length(curve, spacing):
    """
    Sample a Rhino curve by approximately equal arc-length spacing.
    spacing is in Rhino model units, assumed mm.
    """

    length = curve.GetLength()

    if length <= 0:
        return []

    count = int(math.ceil(length / spacing))
    pts = []

    for i in range(count + 1):
        d = min(i * spacing, length)
        success, t = curve.LengthParameter(d)

        if success:
            pts.append(curve.PointAt(t))

    return pts


def make_transform_to_print_plane(target_plane):
    """
    Assumption:
    The original GH curve is modelled in WorldXY.
    This transform places it onto the user-defined print_plane.
    """

    source_plane = rg.Plane.WorldXY
    return rg.Transform.PlaneToPlane(source_plane, target_plane)


def transform_points(points, xform):
    transformed = []

    for pt in points:
        p = rg.Point3d(pt)
        p.Transform(xform)
        transformed.append(p)

    return transformed


def make_nozzle_planes(points, base_plane):
    """
    Generate visualization planes for the nozzle movement.

    For the first version:
    - plane origin = sampled path point
    - plane X/Y/Z axes follow print_plane orientation
    - this means fixed nozzle orientation along the path
    """

    planes = []

    for pt in points:
        pl = rg.Plane(pt, base_plane.XAxis, base_plane.YAxis)
        planes.append(pl)

    return planes


def point_to_ur_pose(pt, plane):
    """
    Convert GH point + plane orientation to UR pose.

    Important:
    This first version assumes fixed orientation.
    Position is converted from mm to m.

    Rotation vector is currently set manually.
    You should replace rx, ry, rz after robot TCP orientation calibration.
    """

    x = pt.X / 1000.0
    y = pt.Y / 1000.0
    z = pt.Z / 1000.0

    # --------------------------------------------------------
    # IMPORTANT:
    # These are placeholder orientation values.
    #
    # If your print_plane already represents the intended
    # nozzle TCP orientation, then the next development step
    # is converting plane orientation matrix to UR rotation vector.
    #
    # For first air-print tests, using a fixed calibrated
    # rx, ry, rz is usually safer.
    # --------------------------------------------------------

    rx = math.pi
    ry = 0.0
    rz = 0.0

    return "p[{:.6f}, {:.6f}, {:.6f}, {:.6f}, {:.6f}, {:.6f}]".format(
        x, y, z, rx, ry, rz
    )


def offset_point_along_plane_z(pt, plane, distance_mm):
    """
    Offset a point along the positive Z axis of a given plane.
    Useful for approach and lift movement.
    """

    vec = rg.Vector3d(plane.ZAxis)
    vec.Unitize()
    vec *= distance_mm

    return pt + vec


# ============================================================
# Main process
# ============================================================

curves = ensure_curve_list(C)

all_points = []
all_planes = []

xform = make_transform_to_print_plane(print_plane)

for crv in curves:
    raw_pts = sample_curve_by_length(crv, point_spacing)
    placed_pts = transform_points(raw_pts, xform)

    all_points.extend(placed_pts)

    nozzle_planes = make_nozzle_planes(placed_pts, print_plane)
    all_planes.extend(nozzle_planes)


# ============================================================
# Generate URScript
# ============================================================

lines = []

lines.append("def f3dp_print():")
lines.append("")
lines.append("  # ------------------------------")
lines.append("  # UR10 / F3DP print setup")
lines.append("  # ------------------------------")
lines.append("  set_tcp(p[{:.6f}, {:.6f}, {:.6f}, {:.6f}, {:.6f}, {:.6f}])".format(
    tcp_x, tcp_y, tcp_z, tcp_rx, tcp_ry, tcp_rz
))
lines.append("  set_payload(1.0)")
lines.append("")
lines.append("  # Robot speed")
lines.append("  # Input speed: {:.1f} mm/min".format(speed_mm_min))
lines.append("  # Converted speed: {:.6f} m/s".format(speed_m_s))
lines.append("")
lines.append("  # Material reference")
lines.append("  # Flow rate: 1.62 kg/min")
lines.append("  # Flow rate: 2.56 L/min")
lines.append("")

if len(all_points) > 0:

    first_pt = all_points[0]
    last_pt = all_points[-1]

    approach_pt = offset_point_along_plane_z(first_pt, print_plane, approach_height)
    lift_pt = offset_point_along_plane_z(last_pt, print_plane, approach_height)

    approach_pose = point_to_ur_pose(approach_pt, print_plane)
    start_pose = point_to_ur_pose(first_pt, print_plane)
    lift_pose = point_to_ur_pose(lift_pt, print_plane)

    lines.append("  # ------------------------------")
    lines.append("  # Approach")
    lines.append("  # ------------------------------")
    lines.append("  movej({}, a=0.5, v=0.1)".format(approach_pose))
    lines.append("  movel({}, a={:.3f}, v={:.6f})".format(
        start_pose, accel, speed_m_s
    ))
    lines.append("")

    lines.append("  # ------------------------------")
    lines.append("  # Start extrusion")
    lines.append("  # ------------------------------")
    lines.append("  set_digital_out({}, True)".format(digital_out))
    lines.append("  sleep({:.3f})".format(delay_before))
    lines.append("")

    lines.append("  # ------------------------------")
    lines.append("  # Printing path")
    lines.append("  # ------------------------------")

    for i, pt in enumerate(all_points):
        pose = point_to_ur_pose(pt, print_plane)

        # Avoid blending at the last point.
        if i < len(all_points) - 1 and blend_radius_m > 0:
            lines.append("  movel({}, a={:.3f}, v={:.6f}, r={:.6f})".format(
                pose, accel, speed_m_s, blend_radius_m
            ))
        else:
            lines.append("  movel({}, a={:.3f}, v={:.6f})".format(
                pose, accel, speed_m_s
            ))

    lines.append("")
    lines.append("  # ------------------------------")
    lines.append("  # Stop extrusion")
    lines.append("  # ------------------------------")
    lines.append("  sleep({:.3f})".format(delay_after))
    lines.append("  set_digital_out({}, False)".format(digital_out))
    lines.append("")

    lines.append("  # ------------------------------")
    lines.append("  # Lift")
    lines.append("  # ------------------------------")
    lines.append("  movel({}, a=0.3, v=0.05)".format(lift_pose))

else:
    lines.append("  # No valid curve points generated.")

lines.append("")
lines.append("end")


# ============================================================
# Outputs
# ============================================================

URScript = "\n".join(lines)
Planes = all_planes
Points = all_points
# ---------- end py3_3 ----------
pln = Plane(py3_3.Planes)
pt_6 = Point(py3_3.Points)
pline = PolyLine(Vertices=pt_6, Closed=False)
panel_12 = Panel(py3_3.URScript)

# ---- group: printing info
dimension_check = DimensionCheck(geo=join_5)  # -> X, Y, Z
panel_13 = Panel(dimension_check.X)
panel_14 = Panel(dimension_check.Y)
panel_15 = Panel(dimension_check.Z)

volume = MeshVolume(Mesh=mpipe)  # -> Volume, Centroid
len_4 = Length(Curve=crv_nonplanar)
division_8 = Division(A=len_4, B="1000")
division_9 = Division(A=len_4, B=number_slider_13)
division_10 = Division(A=volume.Volume, B="1000000")
multiplication_4 = Multiplication(A=division_10, B="0.733")
distance_m = Panel(division_8)
printing_time_min = Panel(division_9)
volume_l = Panel(division_10)
weight_kg = Panel(multiplication_4)

# ---- group: nozzle visualization
X_8 = UnitX(Factor=1)
Y_3 = UnitY(Factor=1)
pt_7 = Point(Point(0, -404.2, 1031.98))
pl_2 = ConstructPlane(Origin=pt_7, XAxis=X_8, YAxis=Y_3)
nozzle = BlockInstance(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)
orient = Orient(Geometry=nozzle, Source=pl_2, Target=pln)  # -> Geometry, Transform
geo_4 = Geometry(orient.Geometry)
increment = Increment(BeginningNumber=0, StepSize=1, Items=geo_4, currentValue=60, increment=1, oldStart=0)  # -> Output, Item
item_10 = ListItem(List=geo_4, Index=Slider(481, range=0..2100), Wrap=True)

# ---- group: Non-planar_a
number_slider_14 = Slider(200, range=0..1000)  # disabled
Z_12 = UnitZ(Factor=dispatch.ListA)  # disabled

panel_16 = Panel("{0,0,0}")  # disabled
number_slider_15 = Slider(0, range=0..10)  # disabled
number_slider_16 = Slider(20, range=0..100)  # disabled
neg_3 = Negative(Value=number_slider_16)  # disabled
panel_17 = Panel("-1")  # disabled
tail_length_4 = Slider(300, range=0..1000)  # disabled
X_9 = UnitX(Factor=1)  # disabled
number_slider_17 = Slider(5, range=0..10)  # disabled

cir_2 = Circle(Plane=panel_16, Radius=number_slider_14)  # disabled
ptdivcrvsegs_2 = PointDivideCurveSegments(Curve=cir_2, Number=number_slider, EndPoint=False)  # -> Points, Tangents, Parameters; disabled
dispatch_13 = Dispatch(List=ptdivcrvsegs_2.Points, DispatchPattern=[True, False])  # -> ListA, ListB; disabled
move_7 = Move(Geometry=dispatch_13.ListA, Motion=Z_12)  # -> Geometry, Transform; disabled
weave_7 = Weave(Pattern=[0, 1], Stream0=move_7.Geometry, Stream1=dispatch_13.ListB, NullGaps=False)  # disabled
intcrv_3 = Interpolate(Vertices=weave_7, Degree=3, Periodic=invert(False), KnotStyle=1)  # -> Curve, Length, Domain; disabled

number_slider_18 = Slider(30, range=0..100)  # disabled
vec2pt = Vector2Pt(PointA=panel_16, PointB=move_7.Geometry, Unitize=invert(False))  # -> Vector, Length; disabled
amp = Amplitude(Vector=vec2pt.Vector, Amplitude=number_slider_18)  # disabled
move_8 = Move(Geometry=move_7.Geometry, Motion=amp)  # -> Geometry, Transform; disabled
weave_8 = Weave(Pattern=[0, 1], Stream0=move_8.Geometry, Stream1=dispatch_13.ListB, NullGaps=False)  # disabled
intcrv_4 = Interpolate(Vertices=weave_8, Degree=3, Periodic=invert(False), KnotStyle=1)  # -> Curve, Length, Domain; disabled
rotate_3 = Rotate(Geometry=intcrv_4.Curve, Angle=degrees(multiplication_2), Plane=PlaneXY(0, 0, 0))  # -> Geometry, Transform; disabled

pdecon_3 = Deconstruct(Point=weave_7)  # -> XComponent, YComponent, ZComponent; disabled
sort_4 = SortList(Keys=pdecon_3.ZComponent, ValuesA=weave_7)  # -> Keys, ValuesA; disabled
item_11 = ListItem(List=sort_4.ValuesA, Index=0, Wrap=True)  # disabled
crv_cp = CurveClosestPoint(Point=item_11, Curve=intcrv_3.Curve)  # -> Point, Parameter, Distance; disabled
seam = Seam(Curve=intcrv_3.Curve, Seam=crv_cp.Parameter)  # disabled

number_slider_19 = Slider(30, range=0..100)  # disabled
pt_8 = Point(dispatch_13.ListB)  # disabled
vec2pt_2 = Vector2Pt(PointA=panel_16, PointB=pt_8, Unitize=invert(False))  # -> Vector, Length; disabled
amp_2 = Amplitude(Vector=vec2pt_2.Vector, Amplitude=number_slider_19)  # disabled
move_9 = Move(Geometry=pt_8, Motion=amp_2)  # -> Geometry, Transform; disabled
weave_9 = Weave(Pattern=[0, 1], Stream0=move_7.Geometry, Stream1=move_9.Geometry, NullGaps=False)  # disabled
intcrv_5 = Interpolate(Vertices=weave_9, Degree=3, Periodic=invert(False), KnotStyle=1)  # -> Curve, Length, Domain; disabled

pdecon_4 = Deconstruct(Point=weave_9)  # -> XComponent, YComponent, ZComponent; disabled
sort_5 = SortList(Keys=pdecon_4.ZComponent, ValuesA=weave_9)  # -> Keys, ValuesA; disabled
item_12 = ListItem(List=sort_5.ValuesA, Index=0, Wrap=True)  # disabled
crv_cp_2 = CurveClosestPoint(Point=item_12, Curve=intcrv_5.Curve)  # -> Point, Parameter, Distance; disabled
seam_2 = Seam(Curve=intcrv_5.Curve, Seam=crv_cp_2.Parameter)  # disabled

rotate_4 = Rotate(Geometry=seam_2, Angle=degrees(multiplication_3), Plane=PlaneXY(0, 0, 0))  # -> Geometry, Transform; disabled

number_slider_20 = Slider(300, range=0..1000)  # disabled
division_11 = Division(A=number_slider_20, B=number_slider_12)  # disabled
Z_13 = UnitZ(Factor=number_slider_20)  # disabled
round_2 = Round(Number=division_11)  # -> Nearest, Floor, Ceiling; disabled
move_10 = Move(Geometry=rotate_4.Geometry, Motion=Z_13)  # -> Geometry, Transform; disabled
range_8 = Range(Domain=Domain(0, 1), Steps=expr("x-1", round_2.Ceiling))  # disabled
rulesrf_3 = RuledSurface(CurveA=seam, CurveB=move_10.Geometry)  # disabled
tweencrv_3 = TweenCurve(CurveA=seam, CurveB=move_10.Geometry, Factor=range_8, BlendType=0)  # disabled

ptdivcrvsegs_3 = PointDivideCurveSegments(Curve=tweencrv_3, Number=number_slider, EndPoint=False)  # -> Points, Tangents, Parameters; disabled
ext_2 = ExtendCurve(Curve=tweencrv_3, Type=0, Start=number_slider_15, End=neg_3)  # disabled
flip_8 = FlipMatrix(Data=ptdivcrvsegs_3.Points)  # disabled
end_12 = EndPoints(Curve=ext_2)  # -> Start, End; disabled
shift_2 = ShiftList(List=end_12.Start, Shift=1, Wrap=invert(True))  # disabled
pline_2 = PolyLine(Vertices=flip_8, Closed=False)  # -> flatten(Polyline); disabled
cull_i_15 = CullIndex(List=end_12.End, Indices=panel_17, Wrap=True)  # disabled
explode_2 = Explode(Curve=pline_2, Recursive=True)  # -> Segments, Vertices; disabled
ln_15 = Line(StartPoint=cull_i_15, EndPoint=shift_2)  # disabled
len_5 = Length(Curve=explode_2.Segments)  # disabled
join_12 = JoinCurves(Curves=flatten([ext_2, ln_15]), Preserve=False)  # disabled
sort_6 = SortList(Keys=flatten(len_5), ValuesA=flatten(explode_2.Segments))  # -> Keys, ValuesA; disabled
end_13 = EndPoints(Curve=join_12)  # -> Start, End; disabled
first_last_3 = FirstLast(List=sort_6.Keys)  # -> FirstValue, LastValue; disabled
line_11 = LineSDL(Start=end_13.Start, Direction=X_9, Length=tail_length_4)  # disabled
join_13 = JoinCurves(Curves=[line_11, join_12], Preserve=False)  # disabled
panel_18 = Panel(first_last_3.FirstValue)  # disabled
panel_19 = Panel(first_last_3.LastValue)  # disabled
mindex_5 = MemberIndex(Set=sort_6.Keys, Member=first_last_3.FirstValue)  # -> Index, Count; disabled
mindex_6 = MemberIndex(Set=sort_6.Keys, Member=first_last_3.LastValue)  # -> Index, Count; disabled
flip_9 = FlipCurve(Curve=join_13)  # -> Curve, Flag; disabled
item_13 = ListItem(List=sort_6.ValuesA, Index=[mindex_5.Index, mindex_6.Index], Wrap=True)  # disabled
curvepoint_2 = PointOnCurve(flip_9.Curve, parameter=0.124)  # disabled
crv_5 = Curve(flip_9.Curve)  # disabled
crv_6 = Curve(item_13)  # disabled
mpipe_2 = MeshPipe(Curve=crv_5, Radius=number_slider_17, Accuracy=0.2, Rotation=0, Segments=10, Caps=2)  # disabled

# ==== cluster DimensionCheck
geo = ClusterInput()
bbox = BoundingBox(Content=geo, Plane=PlaneXY(0, 0, 0))  # -> Box, Box_2
debox = DeconstructBox(Box=bbox.Box)  # -> Plane, X, Y, Z
dedomain = DeconstructDomain(Domain=debox.X)  # -> Start, End
dedomain_2 = DeconstructDomain(Domain=debox.Y)  # -> Start, End
dedomain_3 = DeconstructDomain(Domain=debox.Z)  # -> Start, End
subtraction = Subtraction(A=dedomain.End, B=dedomain.Start)
subtraction_2 = Subtraction(A=dedomain_2.End, B=dedomain_2.Start)
subtraction_3 = Subtraction(A=dedomain_3.End, B=dedomain_3.Start)
X = ClusterOutput(subtraction)
Y = ClusterOutput(subtraction_2)
Z = ClusterOutput(subtraction_3)
panel = Panel(subtraction)
panel_2 = Panel(subtraction_2)
panel_3 = Panel(subtraction_3)
