# Grasshopper definition nadja_test.gh (Grasshopper 1.0.8)
# plug-ins: Robots, Human

# ---- group: Mixer
geo = Geometry(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)  # disabled
pln = Plane(PlaneXY(-404.2, 0, 1031.98))  # disabled

xy = XYPlane(Origin=Point(0, 0, 0))  # disabled
geo_2 = Geometry(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)  # disabled
pt = Point(Point(0, 452.5, 120))  # disabled

# ----
panel = Panel("{0,0,1}")  # disabled
panel_2 = Panel("{1,0,0}")  # disabled

# ---- group: Mixer
pln_2 = Plane(PlaneXY(-404.2, 0, 1031.98))
geo_3 = Geometry(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)

# ----
pl = ConstructPlane(Origin=pt, XAxis=panel, YAxis=panel_2)  # disabled

# ---- group: Mixer
xy_2 = XYPlane(Origin=Point(0, 0, 0))
geo_4 = Geometry(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)
pt_2 = Point(Point(0, 452.5, 120))

xy_3 = XYPlane(Origin=Point(0, 0, 0))  # disabled
geo_5 = Geometry(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)  # disabled
pt_3 = Point(Point(-1.97444779e-10, -452.5045299, 120))  # disabled

# ----
panel_3 = Panel("{-1,0,0}")  # disabled
panel_4 = Panel("{0,0,-1}")  # disabled
pl_2 = ConstructPlane(Origin=pt_2, XAxis="{0,0,1}", YAxis="{1,0,0}")
pl_3 = ConstructPlane(Origin=pt_3, XAxis=panel_3, YAxis=panel_4)  # disabled

# ---- group: Mixer
xy_4 = XYPlane(Origin=Point(0, 0, 0))
geo_6 = Geometry(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)
pt_4 = Point(Point(-1.97444779e-10, -452.5045299, 120))

# ----
swatch = ColourSwatch(SwatchColor=RGB(255, 255, 255))  # disabled
pl_4 = ConstructPlane(Origin=pt_4, XAxis="{-1,0,0}", YAxis="{0,0,-1}")
swatch_2 = ColourSwatch(SwatchColor=RGB(255, 255, 255))
crv = Curve(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)  # disabled

# ----
# Generate Planes
crv_2 = Curve(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)  # disabled
srf = Surface(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)  # disabled
number_slider = Slider(150, range=0..600)  # disabled
curve_to_planes__non_planar = Python3Script(C=crv, S=srf, point_spacing=number_slider)  # -> out, my_way_planes; inputs C: Curve, S: Surface, point_spacing: Double; disabled
# ---------- curve_to_planes__non_planar: Python ----------
import Rhino.Geometry as rg
import math


def as_list(x):
    if x is None:
        return []
    return x if isinstance(x, (list, tuple)) else [x]


def divide_crv(crv, spacing):
    length = crv.GetLength()
    if length <= 0 or spacing <= 0:
        return []

    pts = []
    count = int(math.ceil(length / spacing))

    for i in range(count + 1):
        d = min(i * spacing, length)
        ok, t = crv.LengthParameter(d)
        if ok:
            pts.append(crv.PointAt(t))

    return pts


def safe_unit(v, fallback): # unitize vector
    v = rg.Vector3d(v)

    if v.Length < 0.001:
        v = rg.Vector3d(fallback)

    v.Unitize()
    return v


def get_xaxis(pts, i):
    if len(pts) < 2:
        return rg.Vector3d(1, 0, 0)

    if i == 0:
        xaxis = pts[1] - pts[0]
    else:
        xaxis = pts[i] - pts[i - 1]

    return safe_unit(xaxis, rg.Vector3d(1, 0, 0))


def make_planar_planes(pts, curve, flip=False):
    planes = []

    for i, pt in enumerate(pts):
        plane = rg.Plane.CreateFromNormal(pt,rg.Vector3d(0,0,1))
        planes.append(plane)

    return planes

def make_nonplanar_planes(pts, curve, surface, flip=False):
    planes = []

    for pt in pts:
        ok, t = curve.ClosestPoint(pt)
        xaxis = curve.TangentAt(t) if ok else rg.Vector3d(1, 0, 0)
        xaxis = safe_unit(xaxis, rg.Vector3d(1, 0, 0))

        ok, u, v = surface.ClosestPoint(pt)
        yaxis = surface.NormalAt(u, v) if ok else rg.Vector3d(0, 0, 1)
        yaxis = safe_unit(yaxis, rg.Vector3d(0, 0, 1))
        
        if flip:
            yaxis *= -1

        zaxis = rg.Vector3d.CrossProduct(xaxis, yaxis)
        zaxis = safe_unit(zaxis, rg.Vector3d(0, 1, 0))

        yaxis = rg.Vector3d.CrossProduct(zaxis, xaxis)
        yaxis = safe_unit(yaxis, rg.Vector3d(0, 0, 1))

        planes.append(rg.Plane(pt, xaxis, yaxis))

    return planes


nonplanar = False
my_way_planes = []

for crv in as_list(C):
    pts = divide_crv(crv, point_spacing)

    if nonplanar and S:
        my_way_planes.extend(make_nonplanar_planes(pts, C, S, flip=False)) # C: single curve
    else:
        my_way_planes.extend(make_planar_planes(pts, C, flip=False))
# ---------- end curve_to_planes__non_planar ----------
pln_3 = Plane(curve_to_planes__non_planar.my_way_planes)  # disabled

crv_3 = Curve(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)

# ----
# Generate Planes
crv_4 = Curve(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)
srf_2 = Surface(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)
curve_to_planes__non_planar_2 = Python3Script(C=crv_3, S=srf_2, point_spacing=Slider(150, range=0..600))  # -> out, my_way_planes; inputs C: Curve, S: Surface, point_spacing: Double; same code as curve_to_planes__non_planar
pln_4 = Plane(curve_to_planes__non_planar_2.my_way_planes)

number_slider_2 = Slider(5, range=0..10)  # disabled
colour_swatch = ColourSwatch(SwatchColor=RGB(0, 254, 255))  # disabled
colour_swatch_2 = ColourSwatch(SwatchColor=RGB(0, 0, 255))  # disabled
colour_swatch_3 = ColourSwatch(SwatchColor=RGB(255, 0, 0))  # disabled
panel_5 = Panel("-100")  # disabled
panel_6 = Panel("100")  # disabled
pt_5 = Point(Point(98.33932257, -533.2896401, 0))  # disabled
X = UnitX(Factor=panel_6)  # disabled
Y = UnitY(Factor=panel_6)  # disabled
panel_7 = Panel("10")  # disabled
move = Move(Geometry=pt_5, Motion=X)  # -> Geometry, Transform; disabled
move_2 = Move(Geometry=pt_5, Motion=Y)  # -> Geometry, Transform; disabled
Z = UnitZ(Factor=panel_7)  # disabled
panel_8 = Panel("-100")
pt_6 = Point(Point(98.33932257, -550.5649013, 0))
move_3 = Move(Geometry=pt_5, Motion=Z)  # -> Geometry, Transform; disabled
move_4 = Move(Geometry=move.Geometry, Motion=Z)  # -> Geometry, Transform; disabled
move_5 = Move(Geometry=move_2.Geometry, Motion=Z)  # -> Geometry, Transform; disabled
X_2 = UnitX(Factor="100")
Y_2 = UnitY(Factor="100")
pt_7 = Point(move_3.Geometry)  # disabled
pt_8 = Point(move_4.Geometry)  # disabled
pt_9 = Point(move_5.Geometry)  # disabled

# ----
# Transform from Rhino to Robot Space
pln_5 = Plane(pln_3)  # disabled
fine_adjust_z_mm = Slider(0.8, range=-5..10)  # disabled
panel_9 = Panel("-314.78")  # disabled
panel_10 = Panel("535.90")  # disabled
panel_11 = Panel("246.86")  # disabled
panel_12 = Panel("-10.85")  # disabled
panel_13 = Panel("534.35")  # disabled
panel_14 = Panel("-9.96")  # disabled
panel_15 = Panel("101.40")  # disabled
panel_16 = Panel("-9.39")  # disabled
panel_17 = Panel("-315.60")  # disabled
pt_10 = ConstructPoint(XCoordinate=panel_10, YCoordinate=panel_15, ZCoordinate=panel_16)  # disabled
pt_11 = ConstructPoint(XCoordinate=panel_11, YCoordinate=panel_9, ZCoordinate=panel_12)  # disabled
pt_12 = ConstructPoint(XCoordinate=panel_13, YCoordinate=panel_17, ZCoordinate=panel_14)  # disabled
rhino = Python3Script(way_planes=pln_5, wobj_origin=pt_7, wobj_xaxis=pt_8, wobj_xypoint=pt_9, z_safe_margin=fine_adjust_z_mm)  # -> out, transformed_planes; inputs way_planes: list of Plane, wobj_origin: Point3d, wobj_xaxis: Point3d, wobj_xypoint: Point3d, z_safe_margin: Double; disabled
# ---------- rhino: Python ----------
import Rhino.Geometry as rg
import math

def set_robot_base(origin, xaxis, xypoint):
    return rg.Plane(origin, xaxis - origin, xypoint - origin)

# def rhino_to_robot_space(rhino_plane, robot_base_plane):
#     T = rg.Transform.PlaneToPlane(rg.Plane.WorldXY, robot_base_plane)
#     robot_plane = rhino_plane.Clone()
#     robot_plane.Transform(T)
#     return robot_plane

def rhino_to_robot_space(rhino_plane, robot_base_plane, flip_z=False):
    T = rg.Transform.PlaneToPlane(rg.Plane.WorldXY, robot_base_plane)
    robot_plane = rhino_plane.Clone()

    if flip_z:
        R = rg.Transform.Rotation(math.pi, robot_plane.XAxis, robot_plane.Origin)
        robot_plane.Transform(R)

    robot_plane.Transform(T)
    return robot_plane

def set_z_safe_margin(planes, safety_margin):
    adjusted = []

    for plane in planes:
        p = plane.Clone()
        p.OriginZ += safety_margin
        adjusted.append(p)

    return adjusted

flip_z = True

robot_base = set_robot_base(wobj_origin, wobj_xaxis, wobj_xypoint)

safer_planes = set_z_safe_margin(way_planes, z_safe_margin)

transformed_planes = []

for plane in safer_planes:
    transformed_planes.append(rhino_to_robot_space(plane, robot_base, flip_z))
# ---------- end rhino ----------
points = PointList(Points=rhino.transformed_planes, Size=10)  # disabled

plane = Plane(rhino.transformed_planes)  # disabled
polyline = PolyLine(Vertices=rhino.transformed_planes, Closed=False)  # disabled

# ---- group: Preview
number_slider_3 = Slider(25, range=0..100)  # disabled
number_slider_4 = Slider(40, range=0..100)  # disabled
number_slider_5 = Slider(3, range=0..10)  # disabled
colour_swatch_4 = ColourSwatch(SwatchColor=RGB(0, 254, 0))  # disabled
polyline_2 = PolyLine(Vertices=plane, Closed=False)  # disabled
cylinder = Cylinder(Base=PlaneXY(0, 0, 0), Radius=number_slider_3, Length=number_slider_4)  # disabled
rectangle_3pt = Rectangle3Pt(PointA=pt_12, PointB=pt_10, PointC=pt_11)  # -> graft(Rectangle), Length; disabled
custom_preview_lineweights = CustomPreviewLineweights(Geometry=polyline, Shader=colour_swatch_4, Thickness=number_slider_2, Absolute=False)  # disabled
plane_2 = Plane(plane)  # disabled
deconstruct_plane = DeconstructPlane(Plane=plane_2)  # -> Origin, XAxis, YAxis, ZAxis; disabled
vector_display = VectorDisplay(Anchor=deconstruct_plane.Origin, Vector=deconstruct_plane.XAxis)  # disabled
point_list = PointList(Points=plane, Size=number_slider_5)  # disabled
custom_preview = CustomPreview(
    Geometry=[cylinder, rectangle_3pt.Rectangle],
    Material=[colour_swatch_4, colour_swatch_3, colour_swatch_2, colour_swatch])  # disabled

# ----
move_6 = Move(Geometry=pt_6, Motion=X_2)  # -> Geometry, Transform
move_7 = Move(Geometry=pt_6, Motion=Y_2)  # -> Geometry, Transform
Z_2 = UnitZ(Factor="10")

# ---- group: Sim
number_slider_6 = Slider(10, range=0..100)  # disabled
panel_18 = Panel("PU_Mixer")  # disabled
create_tool = CreateTool(Name=panel_18, TCP=pl, Weight=number_slider_6, Mesh=geo_2)  # -> Tool, TCP; disabled

# ----
move_8 = Move(Geometry=pt_6, Motion=Z_2)  # -> Geometry, Transform
move_9 = Move(Geometry=move_6.Geometry, Motion=Z_2)  # -> Geometry, Transform
move_10 = Move(Geometry=move_7.Geometry, Motion=Z_2)  # -> Geometry, Transform
pt_13 = Point(move_8.Geometry)
pt_14 = Point(move_9.Geometry)
pt_15 = Point(move_10.Geometry)

# ----
# Transform from Rhino to Robot Space
pln_6 = Plane(pln_4)
fine_adjust_z_mm_2 = Slider(0.8, range=-5..10)
pt_16 = ConstructPoint(XCoordinate="535.90", YCoordinate="101.40", ZCoordinate="-9.39")
pt_17 = ConstructPoint(XCoordinate="246.86", YCoordinate="-314.78", ZCoordinate="-10.85")
pt_18 = ConstructPoint(XCoordinate="534.35", YCoordinate="-315.60", ZCoordinate="-9.96")
rhino_2 = Python3Script(way_planes=pln_6, wobj_origin=pt_13, wobj_xaxis=pt_14, wobj_xypoint=pt_15, z_safe_margin=fine_adjust_z_mm_2)  # -> out, transformed_planes; inputs way_planes: list of Plane, wobj_origin: Point3d, wobj_xaxis: Point3d, wobj_xypoint: Point3d, z_safe_margin: Double; same code as rhino
points_2 = PointList(Points=rhino_2.transformed_planes, Size=10)

# ---- group: Sim
create_tool_2 = CreateTool(Name="PU_Mixer", TCP=pl_2, Weight=Slider(2, range=0..100), Mesh=geo_4)  # -> Tool, TCP

# ----
pln_7 = Plane(rhino.transformed_planes)  # disabled

# ----
# Convert Planes to URScript
number_slider_7 = Slider(1, range=0..2)  # disabled
number_slider_8 = Slider(0.2, range=0..1)  # disabled
number_slider_9 = Slider(6, range=0..20)  # disabled
panel_19 = Panel("-452.5")  # disabled
panel_20 = Panel("-120")  # disabled
panel_21 = Panel("0")  # disabled
pt_19 = ConstructPoint(XCoordinate=panel_20, YCoordinate=panel_21, ZCoordinate=panel_19)  # disabled
rhino_3 = Python3Script(
    way_planes=rhino.transformed_planes,
    tcp_measured=pt,
    radius=number_slider_9,
    acceleration=number_slider_7,
    velocity=number_slider_8)  # -> out, script; inputs way_planes: list of Plane, tcp_measured: Point3d, radius: Double, acceleration: Double, velocity: Double; disabled
# ---------- rhino_3: Python ----------
from imp import reload
import sys

sys.path.append("C:\\Users\\nadja\\Documents\\GITHUB\\F3DP\\01 tamplate\\02_RoboticDrawing\\src")

import simple_ur_script as ur
reload(ur)

import utils 
reload(utils)

import simple_comm as com
reload(com)

import Rhino.Geometry as rg
import math as m

script = "" #create empty string

#if value given for tcp measured, then add line to script, otherwise it will take current tcp from robot
if tcp_measured is not None:
    script += ur.set_tcp_by_angles(tcp_measured.X, tcp_measured.Y, tcp_measured.Z, m.radians(0.0),m.radians(0.0),m.radians(0))

#calculate blend
blend_radii = utils.calculate_blend_radius(way_planes, radius=radius)
#add move_l commands to script for each way plane
for plane, radius in zip(way_planes, blend_radii):
    script += ur.move_l_blend(plane, acceleration, velocity, radius)


#format the script to make it sendable
script = com.concatenate_script(script)
# ---------- end rhino_3 ----------

# ---- group: Sim
robots_library = RobotsLibrary({"UR3e", "UR5e", "UR10e", "UR16e", "UR3", "UR5", "UR10", "UR20", "UR30"}, selected="UR10", Type=0)  # disabled
load_robot_system = LoadRobotSystem(Name=robots_library, Base=PlaneXY(0, 0, 0))  # disabled
number_slider_10 = Slider(0.865, range=0..1)  # disabled
createtarget = CreateTarget(Plane=pln_7, Tool=create_tool.Tool, Speed=number_slider_8, IsCartesian=True)  # disabled
create_program = CreateProgram(Name="DefaultProgram", RobotSystem=load_robot_system, Targets=createtarget, StepSize=1)  # -> Program, Code, Duration, Warnings, Errors; disabled
program_simulation = ProgramSimulation(Program=create_program.Program, Time=0, Normalized=True)  # -> SystemMeshes, JointRotations, Plane, Index, Time, Program, Errors; disabled
panel_22 = Panel(create_program.Warnings)  # disabled
panel_23 = Panel(program_simulation.Errors)  # disabled

# ----
pline = PolyLine(Vertices=pln_7, Closed=False)  # disabled
number_slider_11 = Slider(0, range=0..1)  # disabled
pln_8 = Plane(rhino_2.transformed_planes)

# ----
# Convert Planes to URScript
number_slider_12 = Slider(6, range=0..20)
number_slider_13 = Slider(1, range=0..2)
number_slider_14 = Slider(0.2, range=0..1)
pt_20 = ConstructPoint(XCoordinate="-120", YCoordinate="0", ZCoordinate="-452.5")
rhino_4 = Python3Script(
    way_planes=rhino_2.transformed_planes,
    tcp_measured=pt_2,
    radius=number_slider_12,
    acceleration=number_slider_13,
    velocity=number_slider_14)  # -> out, script; inputs way_planes: list of Plane, tcp_measured: Point3d, radius: Double, acceleration: Double, velocity: Double; same code as rhino_3

# ---- group: Sim
robots_library_2 = RobotsLibrary({"UR3e", "UR5e", "UR10e", "UR16e", "UR3", "UR5", "UR10", "UR20", "UR30"}, selected="UR5e", Type=0)
load_robot_system_2 = LoadRobotSystem(Name=robots_library_2, Base=PlaneXY(0, 0, 0))
number_slider_15 = Slider(0.865, range=0..1)
createtarget_2 = CreateTarget(Plane=pln_8, Tool=create_tool_2.Tool, Speed=number_slider_14, IsCartesian=True)
create_program_2 = CreateProgram(Name="DefaultProgram", RobotSystem=load_robot_system_2, Targets=createtarget_2, StepSize=1)  # -> Program, Code, Duration, Warnings, Errors
program_simulation_2 = ProgramSimulation(Program=create_program_2.Program, Time=0, Normalized=True)  # -> SystemMeshes, JointRotations, Plane, Index, Time, Program, Errors
panel_24 = Panel(create_program_2.Warnings)
panel_25 = Panel(program_simulation_2.Errors)

# ----
pline_2 = PolyLine(Vertices=pln_8, Closed=False)
programsimulation = ProgramSimulation(Program=create_program.Program, Time=number_slider_11, Normalized=True)  # -> SystemMeshes, JointRotations, Plane, Index, Time, Program, Errors; disabled

# ---- group: Send UR script to Robot!
# Send to Robot!
button = Button()  # disabled
panel_26 = Panel("192.168.10.10")  # disabled
py3 = Python3Script(script=rhino_3.script, ip_address=panel_26, send=button)  # -> out, a; inputs script: String, ip_address: String, send: Boolean; disabled
# ---------- py3: Python ----------
import simple_comm as com

if send:
    com.send_script(script,ip_address)
# ---------- end py3 ----------

# ----
urscript = Panel(rhino_3.script)  # disabled
pln_9 = Plane(program_simulation.Plane)  # disabled
preview = CustomPreview(
    Geometry=programsimulation.SystemMeshes,
    Material={diffuse=RGB(221, 160, 221), emission=RGB(66, 48, 66), shine=0.5, specular=RGB(255, 255, 255), transparency=0})  # disabled
programsimulation_2 = ProgramSimulation(Program=create_program_2.Program, Time=Slider(0, range=0..1), Normalized=True)  # -> SystemMeshes, JointRotations, Plane, Index, Time, Program, Errors

# ---- group: Send UR script to Robot!
# Send to Robot!
button_2 = Button()
py3_2 = Python3Script(script=rhino_4.script, ip_address="192.168.10.10", send=button_2)  # -> out, a; inputs script: String, ip_address: String, send: Boolean; same code as py3

# ----
urscript_2 = Panel(rhino_4.script)
pln_10 = Plane(program_simulation_2.Plane)
preview_2 = CustomPreview(
    Geometry=programsimulation_2.SystemMeshes,
    Material={diffuse=RGB(221, 160, 221), emission=RGB(66, 48, 66), shine=0.5, specular=RGB(255, 255, 255), transparency=0})
