# Grasshopper definition sika UR setting.ghx (Grasshopper 1.0.8)
# plug-ins: Robots, treesloth01, Human

# ----
# TCP
pln_flange = Plane(Plane(origin=(0, 0, 0), x=(-0.9999872084, 0.005057970604, 0), y=(0.005057970604, 0.9999872084, 0)))
pln_tcp = Plane(PlaneYZ(452.5045299, 1.978150976e-10, -120))
geo = Geometry(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)

# ---- group: Sim
create_tool = CreateTool(Name="PU_Mixer", TCP=<missing>, Weight=Slider(1, range=0..10), Mesh=<missing>)  # -> Tool, TCP

# ----
pyramid = JoinCurves(Curves=flatten([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]), Preserve=False)
rotate_bridging_same = Curve(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)
rotate_bridging_different = Curve(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)

# ---- group: Sim / Approach
create_target = CreateTarget(Plane=<missing>, Tool=create_tool.Tool, Speed=<missing>, Frame=<missing>, IsCartesian=True)

# ---- group: Sim
robots_library = RobotsLibrary({"UR5e (missing)": "UR5e"}, selected="UR5e (missing)", Type=0)
load_robot_system = LoadRobotSystem(Name=robots_library, Base=PlaneXY(0, 0, 0))
create_program = CreateProgram(Name="DefaultProgram", RobotSystem=load_robot_system, Targets=create_target, StepSize=1)  # -> Program, Code, Duration, Warnings, Errors
program_simulation = ProgramSimulation(Program=create_program.Program, Time=Slider(0.007, range=0..1), Normalized=True)  # -> SystemMeshes, JointRotations, Plane, Index, Time, Program, Errors
panel = Panel(program_simulation.Errors)

# ----
number_slider = Slider(550, range=0..1000)
number_slider_2 = Slider(-200, range=-1000..500)
number_slider_3 = Slider(32, range=-500..500)

# ----
# To Printing Bed
number_slider_4 = Slider(0, range=-1000..500)
vec = VectorXYZ(XComponent=Slider(600, range=0..1000), YComponent=number_slider_4, ZComponent=Slider(32, range=-500..500))  # -> Vector, Length
move = Move(Geometry=pyramid, Motion=vec.Vector)  # -> Geometry, Transform

# ----
# Generate Planes
curve_to_planes_polyline = Python3Script(C=move.Geometry, xyplane_printing=Toggle(True))  # -> out, my_way_planes, plane_polylines; inputs C: Curve, xyplane_printing: Boolean
# ---------- curve_to_planes_polyline: Python ----------
import Rhino.Geometry as rg
import math


def as_list(x):
    return [] if x is None else x if isinstance(x, list) else [x]


def safe_unit(v, fallback):
    v = rg.Vector3d(v)
    if v.Length < 0.001:
        v = rg.Vector3d(fallback)
    v.Unitize()
    return v


def get_polyline_pts(crv):
    if isinstance(crv, rg.Polyline):
        return list(crv)

    ok, pl = crv.TryGetPolyline()
    if ok:
        return list(pl)

    return []


def get_tangent(pts, i):
    if len(pts) < 2:
        return rg.Vector3d.XAxis

    if i == 0:
        v = pts[1] - pts[0]
    else:
        v = pts[i] - pts[i - 1]

    return safe_unit(v, rg.Vector3d.XAxis)


def angle_to_xy(v):
    v = safe_unit(v, rg.Vector3d.XAxis)
    return math.degrees(math.asin(abs(v.Z)))


def make_planes_xyplane(pts):
    planes = []

    for i, pt in enumerate(pts):
        plane = rg.Plane.CreateFromNormal(pt,rg.Vector3d(0,0,1))
        planes.append(plane)

    return planes, rg.Polyline(pts)


def make_planes_from_polyline(pts, angle_limit=45.0):
    planes = []

    for i, pt in enumerate(pts):
        tangent = get_tangent(pts, i)

        if angle_to_xy(tangent) > angle_limit:
            zaxis = rg.Vector3d(tangent)

            if zaxis.Z < 0:
                zaxis *= -1

            xaxis = rg.Vector3d.CrossProduct(rg.Vector3d.ZAxis, zaxis)

            if xaxis.Length < 0.001:
                xaxis = rg.Vector3d.XAxis

            xaxis.Unitize()
            yaxis = rg.Vector3d.CrossProduct(zaxis, xaxis)
            yaxis.Unitize()

            plane = rg.Plane(pt, xaxis, yaxis)

        else:
            plane = rg.Plane(pt, rg.Vector3d.XAxis, rg.Vector3d.YAxis)

        if plane.ZAxis.Z < 0:
            plane.Flip()

        planes.append(plane)

    return planes, rg.Polyline(pts)


my_way_planes = []
plane_polylines = []

for crv in as_list(C):
    pts = get_polyline_pts(crv)

    if xyplane_printing:
        planes, pline = make_planes_xyplane(pts)
    else:
        planes, pline = make_planes_from_polyline(pts, angle_limit=45.0)
    

    my_way_planes.extend(planes)
    plane_polylines.append(pline)
# ---------- end curve_to_planes_polyline ----------
pln = Plane(curve_to_planes_polyline.my_way_planes)
crv = Curve(curve_to_planes_polyline.plane_polylines)

curve_to_planes__non_planar = Python3Script(C=move.Geometry, point_spacing=Slider(120, range=0..600))  # -> out, my_way_planes; inputs C: Curve, S: Surface, point_spacing: Double
# ---------- curve_to_planes__non_planar: Python ----------
import Rhino.Geometry as rg
import math


def as_list(x):
    if x is None:
        return []
    return x if isinstance(x, (list, tuple)) else [x]


def divide_crv(crv, spacing):
    length = crv.GetLength()
    if length <= 0 or spacing <= 0:
        return []

    pts = []
    count = int(math.ceil(length / spacing))

    for i in range(count + 1):
        d = min(i * spacing, length)
        ok, t = crv.LengthParameter(d)
        if ok:
            pts.append(crv.PointAt(t))

    return pts


def safe_unit(v, fallback): # unitize vector
    v = rg.Vector3d(v)

    if v.Length < 0.001:
        v = rg.Vector3d(fallback)

    v.Unitize()
    return v


def get_xaxis(pts, i):
    if len(pts) < 2:
        return rg.Vector3d(1, 0, 0)

    if i == 0:
        xaxis = pts[1] - pts[0]
    else:
        xaxis = pts[i] - pts[i - 1]

    return safe_unit(xaxis, rg.Vector3d(1, 0, 0))


def make_planar_planes(pts, curve, flip=False):
    planes = []

    for i, pt in enumerate(pts):
        plane = rg.Plane.CreateFromNormal(pt,rg.Vector3d(0,0,1))
        planes.append(plane)

    return planes


def make_nonplanar_planes(pts, curve, surface, flip=False):
    planes = []

    for pt in pts:
        ok, t = curve.ClosestPoint(pt)
        xaxis = curve.TangentAt(t) if ok else rg.Vector3d(1, 0, 0)
        xaxis = safe_unit(xaxis, rg.Vector3d(1, 0, 0))

        ok, u, v = surface.ClosestPoint(pt)
        yaxis = surface.NormalAt(u, v) if ok else rg.Vector3d(0, 0, 1)
        yaxis = safe_unit(yaxis, rg.Vector3d(0, 0, 1))
        
        if flip:
            yaxis *= -1

        zaxis = rg.Vector3d.CrossProduct(xaxis, yaxis)
        zaxis = safe_unit(zaxis, rg.Vector3d(0, 1, 0))

        yaxis = rg.Vector3d.CrossProduct(zaxis, xaxis)
        yaxis = safe_unit(yaxis, rg.Vector3d(0, 0, 1))

        planes.append(rg.Plane(pt, xaxis, yaxis))

    return planes


nonplanar = False
my_way_planes = []

for crv in as_list(C):
    pts = divide_crv(crv, point_spacing)

    if nonplanar and S:
        my_way_planes.extend(make_nonplanar_planes(pts, crv, S, flip=False)) # C: single curve
    else:
        my_way_planes.extend(make_planar_planes(pts, crv, flip=True))
# ---------- end curve_to_planes__non_planar ----------
pln_2 = Plane(curve_to_planes__non_planar.my_way_planes)
pline = PolyLine(Vertices=pln_2, Closed=False)

shift = ShiftList(List=pln, Shift=1, Wrap=invert(True))  # disabled
number_slider_5 = Slider(8, range=0..11)  # disabled
explode = Explode(Curve=crv, Recursive=True)  # -> Segments, Vertices; disabled
stack = StackTrees(Data0=pln, Data1=shift, Data2=explode.Segments, Reduce=True)  # disabled
item = ListItem(List=stack, Index=number_slider_5, Wrap=True)  # disabled

plane = Plane()
polyline = PolyLine(Closed=False)

# ---- group: Preview
colour_swatch = ColourSwatch(SwatchColor=RGB(0, 254, 0))
polyline_2 = PolyLine(Vertices=plane, Closed=False)
cylinder = Cylinder(Base=PlaneXY(0, 0, 0), Radius=Slider(25, range=0..100), Length=Slider(40, range=0..100))
rectangle_3pt = Rectangle3Pt()  # -> graft(Rectangle), Length
custom_preview_lineweights = CustomPreviewLineweights(Geometry=polyline, Shader=colour_swatch, Thickness=Slider(5, range=0..10), Absolute=False)
plane_2 = Plane(plane)
deconstruct_plane = DeconstructPlane(Plane=plane_2)  # -> Origin, XAxis, YAxis, ZAxis
vector_display = VectorDisplay(Anchor=deconstruct_plane.Origin, Vector=deconstruct_plane.XAxis)
point_list = PointList(Points=plane, Size=Slider(3, range=0..10))
custom_preview = CustomPreview(
    Geometry=rectangle_3pt.Rectangle,
    Material=[colour_swatch, ColourSwatch(SwatchColor=RGB(255, 0, 0)), ColourSwatch(SwatchColor=RGB(0, 0, 255)), ColourSwatch(SwatchColor=RGB(0, 254, 255))])

# ----
# Generate URscript
pln_3 = Plane(pln)
number_slider_6 = Slider(1, range=0..2)
number_slider_7 = Slider(0.2, range=0..1)
plane_tcp_to_urscript = Python3Script(
    way_planes=pln_3,
    tcp_measured="{0, 0, 0}",
    radius=Slider(9, range=0..20),
    acceleration=number_slider_6,
    velocity=number_slider_7)  # -> out, script; inputs way_planes: list of Plane, tcp_measured: Point3d, radius: Double, acceleration: Double, velocity: Double
# ---------- plane_tcp_to_urscript: Python ----------
from imp import reload
import sys

sys.path.append("C:\\Users\\user\\github\\F3DP\\01 tamplate\\02_RoboticDrawing\\src")


import simple_ur_script as ur
reload(ur)

import utils 
reload(utils)

import simple_comm as com
reload(com)

import Rhino.Geometry as rg
import math as m

script = "" #create empty string

#if value given for tcp measured, then add line to script, otherwise it will take current tcp from robot
if tcp_measured is not None:
    script += ur.set_tcp_by_angles(tcp_measured.X, tcp_measured.Y, tcp_measured.Z, m.radians(-90.0),m.radians(-90.0),m.radians(0))

#calculate blend
blend_radii = utils.calculate_blend_radius(way_planes, radius=radius)
#add move_l commands to script for each way plane
for plane, radius in zip(way_planes, blend_radii):
    script += ur.move_l_blend(plane, acceleration, velocity, radius)


#format the script to make it sendable
script = com.concatenate_script(script)
# ---------- end plane_tcp_to_urscript ----------
panel_2 = Panel(plane_tcp_to_urscript.script)

# ---- group: Send UR script to Robot!
py3 = Python3Script(script=plane_tcp_to_urscript.script, ip_address="192.168.10.10", send=Button())  # -> out, a; inputs script: String, ip_address: String, send: Boolean
# ---------- py3: Python ----------
import simple_comm as com

if send:
    com.send_script(script,ip_address)
# ---------- end py3 ----------
