# Grasshopper definition sika UR setting_bridging, pyramid_2.gh (Grasshopper 1.0.8)
# plug-ins: Robots, treesloth01, Human

pt = Point(Point(0, 0, 0))
py3 = Python3Script(
    center_pt=pt,
    length=Slider(150, range=0..500),
    height=Slider(150, range=0..500),
    x_movement=Slider(0, range=-1..1),
    y_movement=Slider(0, range=-1..1))  # -> out, points, polyline, pyramid_trail; inputs center_pt: Point3d, length: Double, height: Double, x_movement: Double, y_movement: Double
# ---------- py3: Python ----------
import Rhino.Geometry as rg

def make_pyramid(center_pt, length, height, x_movement=0.0, y_movement=0.0):
    h = length / 2.0

    p0 = rg.Point3d(center_pt.X - h, center_pt.Y - h, center_pt.Z)
    p1 = rg.Point3d(center_pt.X + h, center_pt.Y - h, center_pt.Z)
    p2 = rg.Point3d(center_pt.X + h, center_pt.Y + h, center_pt.Z)
    p3 = rg.Point3d(center_pt.X - h, center_pt.Y + h, center_pt.Z)

    # Move apex along X and Y
    x_para = x_movement * length
    y_para = y_movement * length

    p4 = rg.Point3d(
        center_pt.X + x_para,
        center_pt.Y + y_para,
        center_pt.Z + height
    )

    pts = [p0, p1, p2, p3, p4]

    path_pts = [
        p0, p1, p4,
        p2, p1,
        p2, p4,
        p3, p2,
        p3, p4,
        p0, p3,
        p0
    ]

    polyline = rg.Polyline(path_pts)

    trail_pts = [
        p3, p0, p2, p1, p4,
        p2, p3, p4,p0, p1
    ]

    pyramid_trail = rg.Polyline(trail_pts)

    return pts, polyline, pyramid_trail


points, polyline, pyramid_trail = make_pyramid(
    center_pt,
    length,
    height,
    x_movement,
    y_movement
)
# ---------- end py3 ----------
pyramid = Curve(py3.pyramid_trail)
points = PointList(Points=py3.points, Size=10)

pt_2 = Point(Point(0, 0, 0))
py3_2 = Python3Script(
    center_pt=pt_2,
    length=Slider(250, range=0..500),
    height=Slider(200, range=0..500),
    x_movement=Slider(0, range=-1..1),
    y_movement=Slider(0, range=-1..1))  # -> out, points, polyline, pyramid_trail; inputs center_pt: Point3d, length: Double, height: Double, x_movement: Double, y_movement: Double
# ---------- py3_2: Python ----------
import Rhino.Geometry as rg

layer_height = 10

def make_pyramid(center_pt, length, height, layer_height = 10, x_movement=0.0, y_movement=0.0):
    h = length / 2.0

    p0 = rg.Point3d(center_pt.X - h, center_pt.Y - h, center_pt.Z)
    p1 = rg.Point3d(center_pt.X + h, center_pt.Y - h, center_pt.Z)
    p2 = rg.Point3d(center_pt.X + h, center_pt.Y + h, center_pt.Z)
    p3 = rg.Point3d(center_pt.X - h, center_pt.Y + h, center_pt.Z)

    p0_h = rg.Point3d(center_pt.X - h, center_pt.Y - h, center_pt.Z + layer_height)
    p1_h = rg.Point3d(center_pt.X + h, center_pt.Y - h, center_pt.Z + layer_height)
    p2_h = rg.Point3d(center_pt.X + h, center_pt.Y + h, center_pt.Z + layer_height)
    p3_h = rg.Point3d(center_pt.X - h, center_pt.Y + h, center_pt.Z + layer_height)

    # Move apex along X and Y
    x_para = x_movement * length
    y_para = y_movement * length

    p4 = rg.Point3d(center_pt.X + x_para, center_pt.Y + y_para, center_pt.Z + height)
    p4_r = rg.Point3d(center_pt.X + 20+ x_para, center_pt.Y + y_para, center_pt.Z + height)
    p4_h = rg.Point3d(center_pt.X - 20 + x_para, center_pt.Y + y_para, center_pt.Z + height + layer_height)

    pts = [p0, p1, p2, p3, p4]

    path_pts = [
        p0, p1, p4,
        p2, p1,
        p2, p4,
        p3, p2,
        p3, p4,
        p0, p3,
        p0
    ]

    polyline = rg.Polyline(path_pts)

    trail_pts = [
        p3, p0, p2, p1, p4_r,
        p2_h, p3_h, p4_h, p0_h, p1_h
    ]

    pyramid_trail = rg.Polyline(trail_pts)

    return pts, polyline, pyramid_trail


points, polyline, pyramid_trail = make_pyramid(
    center_pt,
    length,
    height,
    layer_height,
    x_movement,
    y_movement
)
# ---------- end py3_2 ----------
points_2 = PointList(Points=py3_2.points, Size=10)
pyramid_2 = Curve(py3_2.pyramid_trail)

pt_3 = Point(Point(0, 0, 0))
py3_3 = Python3Script(
    center_pt=pt_3,
    length=Slider(200, range=0..500),
    height=Slider(500, range=0..500),
    x_movement=Slider(0, range=-1..1),
    y_movement=Slider(-0.5, range=-1..1))  # -> out, points, polyline, pyramid_trail; inputs center_pt: Point3d, length: Double, height: Double, x_movement: Double, y_movement: Double
# ---------- py3_3: Python ----------
import Rhino.Geometry as rg

layer_height = 20

def make_pyramid(center_pt, length, height, layer_height = 10, x_movement=0.0, y_movement=0.0):
    h = length / 2.0

    p0 = rg.Point3d(center_pt.X - h, center_pt.Y - h, center_pt.Z)
    p1 = rg.Point3d(center_pt.X + h, center_pt.Y - h, center_pt.Z)
    p2 = rg.Point3d(center_pt.X + h, center_pt.Y + h, center_pt.Z)
    p3 = rg.Point3d(center_pt.X - h, center_pt.Y + h, center_pt.Z)

    p0_h = rg.Point3d(center_pt.X - h, center_pt.Y - h, center_pt.Z + layer_height)
    p1_h = rg.Point3d(center_pt.X + h, center_pt.Y - h, center_pt.Z + layer_height)
    p2_h = rg.Point3d(center_pt.X + h, center_pt.Y + h, center_pt.Z + layer_height)
    p3_h = rg.Point3d(center_pt.X - h, center_pt.Y + h, center_pt.Z + layer_height)

    # Move apex along X and Y
    x_para = x_movement * length
    y_para = y_movement * length

    p4 = rg.Point3d(center_pt.X + x_para, center_pt.Y + y_para, center_pt.Z + height)
    p4_r = rg.Point3d(center_pt.X + layer_height*5 + x_para, center_pt.Y + y_para, center_pt.Z + height)
    p4_h = rg.Point3d(center_pt.X - layer_height + x_para, center_pt.Y + y_para, center_pt.Z + height + layer_height)

    pts = [p0, p1, p2, p3, p4]

    path_pts = [
        p0, p1, p4,
        p2, p1,
        p2, p4,
        p3, p2,
        p3, p4,
        p0, p3,
        p0
    ]

    polyline = rg.Polyline(path_pts)

    trail_pts = [
        p3, p0, p2, p1, p4_r,
        p2_h, p3_h, p4_h, p0_h, p1_h
    ]

    pyramid_trail = rg.Polyline(trail_pts)

    return pts, polyline, pyramid_trail


points, polyline, pyramid_trail = make_pyramid(
    center_pt,
    length,
    height,
    layer_height,
    x_movement,
    y_movement
)
# ---------- end py3_3 ----------
points_3 = PointList(Points=py3_3.points, Size=10)
pyramid_3 = Curve(py3_3.pyramid_trail)

pt_4 = Point(Point(0, 0, 0))
py3_4 = Python3Script(
    num=Slider(3, range=0..10),
    center_pt=pt_4,
    length=Slider(150, range=0..500),
    height=Slider(150, range=0..500),
    x_movement=Slider(0, range=-1..1),
    y_movement=Slider(0, range=-1..1))  # -> out, points, polyline, pyramid_trail; inputs num: Int32, center_pt: Point3d, length: Double, height: Double, x_movement: Double, y_movement: Double
# ---------- py3_4: Python ----------
import Rhino.Geometry as rg

layer_height = 10

def make_pyramid(center_pt, length, height, layer_height = 10, x_movement=0.0, y_movement=0.0):
    h = length / 2.0

    p0 = rg.Point3d(center_pt.X - h, center_pt.Y - h, center_pt.Z)
    p1 = rg.Point3d(center_pt.X + h, center_pt.Y - h, center_pt.Z)
    p2 = rg.Point3d(center_pt.X + h, center_pt.Y + h, center_pt.Z)
    p3 = rg.Point3d(center_pt.X - h, center_pt.Y + h, center_pt.Z)

    p0_h = rg.Point3d(center_pt.X - h, center_pt.Y - h, center_pt.Z + layer_height)
    p1_h = rg.Point3d(center_pt.X + h, center_pt.Y - h, center_pt.Z + layer_height)
    p2_h = rg.Point3d(center_pt.X + h, center_pt.Y + h, center_pt.Z + layer_height)
    p3_h = rg.Point3d(center_pt.X - h, center_pt.Y + h, center_pt.Z + layer_height)

    # Move apex along X and Y
    x_para = x_movement * length
    y_para = y_movement * length

    p4 = rg.Point3d(center_pt.X + x_para, center_pt.Y + y_para, center_pt.Z + height)
    p4_r = rg.Point3d(center_pt.X + layer_height + x_para, center_pt.Y + y_para, center_pt.Z + height)
    p4_h = rg.Point3d(center_pt.X - layer_height + x_para, center_pt.Y + y_para, center_pt.Z + height + layer_height)

    p1_end = rg.Point3d(center_pt.X + 50, center_pt.Y - h, center_pt.Z + layer_height)

    pts = [p0, p1, p2, p3, p4]

    path_pts = [
        p0, p1, p4,
        p2, p1,
        p2, p4,
        p3, p2,
        p3, p4,
        p0, p3,
        p0
    ]

    polyline = rg.Polyline(path_pts)

    trail_pts = [
        p3, p0, p2, p1, p4_r,
        p2_h, p3_h, p4_h, p0_h, p1_h, p1_end
    ]

    pyramid_trail = rg.Polyline(trail_pts)

    return pts, polyline, pyramid_trail


for n in range(num):


    points, polyline, pyramid_trail = make_pyramid(
        center_pt,
        length,
        height + n*30,
        layer_height,
        x_movement,
        y_movement
    )
# ---------- end py3_4 ----------
points_4 = PointList(Points=py3_4.points, Size=10)
pyramid_4 = Curve(py3_4.pyramid_trail)

# ----
# TCP
pln_flange = Plane(Plane(origin=(0, 0, 0), x=(-0.9999872084, 0.005057970604, 0), y=(0.005057970604, 0.9999872084, 0)))
pln_tcp = Plane(PlaneYZ(452.5045299, 1.978150976e-10, -120))
geo = Geometry(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)

end = EndPoints(Curve=pyramid)  # -> Start, End
Y = UnitY(Factor=1)
line = LineSDL(Start=end.Start, Direction=Y, Length=Slider(200, range=0..1000))

X = UnitX(Factor=1)
line_2 = LineSDL(Start=end.End, Direction=X, Length=Slider(200, range=0..1000))

# ---- group: Sim
create_tool = CreateTool(Name="PU_Mixer", TCP=<missing>, Weight=Slider(1, range=0..10), Mesh=<missing>)  # -> Tool, TCP

# ----
ext = ExtendCurve(Curve=pyramid_2, Type=0, Start=Slider(200, range=0..1000), End=Slider(50, range=0..1000))

ext_2 = ExtendCurve(Curve=pyramid_3, Type=0, Start=Slider(200, range=0..1000), End=Slider(50, range=0..1000))

ext_3 = ExtendCurve(Curve=pyramid_4, Type=0, Start=Slider(200, range=0..1000), End=Slider(50, range=0..1000))

merge = Merge(Data1=line, Data2=pyramid, Data3=line_2)
join = JoinCurves(Curves=flatten(merge), Preserve=False)

rotate_bridging_same = Curve(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)
rotate_bridging_different = Curve(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)

# ---- group: Sim / Approach
create_target = CreateTarget(Plane=<missing>, Tool=create_tool.Tool, Speed=<missing>, Frame=<missing>, IsCartesian=True)

# ---- group: Sim
robots_library = RobotsLibrary({"UR5e (missing)": "UR5e"}, selected="UR5e (missing)", Type=0)
load_robot_system = LoadRobotSystem(Name=robots_library, Base=PlaneXY(0, 0, 0))
create_program = CreateProgram(Name="DefaultProgram", RobotSystem=load_robot_system, Targets=create_target, StepSize=1)  # -> Program, Code, Duration, Warnings, Errors
program_simulation = ProgramSimulation(Program=create_program.Program, Time=Slider(0.007, range=0..1), Normalized=True)  # -> SystemMeshes, JointRotations, Plane, Index, Time, Program, Errors
panel = Panel(program_simulation.Errors)

# ----
number_slider = Slider(550, range=0..1000)
number_slider_2 = Slider(-200, range=-1000..500)
number_slider_3 = Slider(32, range=-500..500)

# ----
# To Printing Bed
number_slider_4 = Slider(0, range=-1000..500)
vec = VectorXYZ(XComponent=Slider(650, range=0..1000), YComponent=number_slider_4, ZComponent=Slider(32, range=-500..500))  # -> Vector, Length
move = Move(Geometry=ext_2, Motion=vec.Vector)  # -> Geometry, Transform

pln = Plane(Plane(origin=(590, -75, 242), x=(0.9510340687, 0, -0.3090860723), y=(0, 1, 0)))

curve_to_planes_polyline = Python3Script(C=move.Geometry, xyplane_printing=Toggle(False))  # -> out, my_way_planes, plane_polylines; inputs C: Curve, xyplane_printing: Boolean
# ---------- curve_to_planes_polyline: Python ----------
import Rhino.Geometry as rg
import math


def as_list(x):
    return [] if x is None else x if isinstance(x, (list, tuple)) else [x]


def safe_unit(v, fallback):
    v = rg.Vector3d(v)
    if v.Length < 0.001:
        v = rg.Vector3d(fallback)
    v.Unitize()
    return v


def get_polyline_pts(crv):
    if isinstance(crv, rg.Polyline):
        return list(crv)

    ok, pl = crv.TryGetPolyline()
    return list(pl) if ok else []


def get_tangent_ahead(crv, pt, look_ahead):
    ok, t = crv.ClosestPoint(pt)
    if not ok:
        return rg.Vector3d.XAxis

    current_len = crv.GetLength(rg.Interval(crv.Domain.T0, t))
    target_len = min(current_len + look_ahead, crv.GetLength())

    ok, t2 = crv.LengthParameter(target_len)
    if not ok:
        return rg.Vector3d.XAxis

    return safe_unit(crv.PointAt(t2) - pt, rg.Vector3d.XAxis)


def angle_to_xy(v):
    v = safe_unit(v, rg.Vector3d.XAxis)
    return math.degrees(math.asin(abs(v.Z)))


def angle_between(v1, v2):
    v1 = safe_unit(v1, rg.Vector3d.XAxis)
    v2 = safe_unit(v2, rg.Vector3d.XAxis)
    dot = max(-1.0, min(1.0, v1 * v2))
    return math.degrees(math.acos(dot))


def rotate_plane_90_best_match(plane, prev_plane):
    """
    Try rotating current plane +90 or -90 degrees around its own ZAxis.
    Keep the version whose XAxis is closer to previous plane XAxis.
    """

    p_plus = rg.Plane(plane)
    p_minus = rg.Plane(plane)

    p_plus.Rotate(math.radians(90), p_plus.ZAxis, p_plus.Origin)
    p_minus.Rotate(math.radians(-90), p_minus.ZAxis, p_minus.Origin)

    a0 = angle_between(plane.XAxis, prev_plane.XAxis)
    a1 = angle_between(p_plus.XAxis, prev_plane.XAxis)
    a2 = angle_between(p_minus.XAxis, prev_plane.XAxis)

    if a1 <= a0 and a1 <= a2:
        return p_plus
    elif a2 <= a0 and a2 <= a1:
        return p_minus
    else:
        return plane


def make_xy_planes(pts):
    planes = [rg.Plane.CreateFromNormal(pt, rg.Vector3d.ZAxis) for pt in pts]
    return planes, rg.Polyline(pts)


def make_planes_from_polyline(crv, pts, angle_limit=45.0, x_angle_limit=80.0, look_ahead=1.0):
    planes = []

    for pt in pts:
        tangent = get_tangent_ahead(crv, pt, look_ahead)

        if angle_to_xy(tangent) > angle_limit:
            zaxis = rg.Vector3d(tangent)

            if zaxis.Z < 0:
                zaxis *= -1

            xaxis = rg.Vector3d.CrossProduct(rg.Vector3d.ZAxis, zaxis)

            if xaxis.Length < 0.001:
                xaxis = rg.Vector3d.XAxis

            xaxis.Unitize()

            yaxis = rg.Vector3d.CrossProduct(zaxis, xaxis)
            yaxis.Unitize()

            plane = rg.Plane(pt, xaxis, yaxis)

        else:
            plane = rg.Plane(pt, rg.Vector3d.XAxis, rg.Vector3d.YAxis)

        if plane.ZAxis.Z < 0:
            plane.Flip()

        # If current XAxis differs too much from previous XAxis,
        # rotate current plane 90 degrees around its own ZAxis.
        if planes:
            x_angle = angle_between(plane.XAxis, planes[-1].XAxis)

            if x_angle > x_angle_limit:
                plane = rotate_plane_90_best_match(plane, planes[-1])

        planes.append(plane)

    return planes, rg.Polyline(pts)


my_way_planes = []
plane_polylines = []

for crv in as_list(C):
    pts = get_polyline_pts(crv)

    if xyplane_printing:
        planes, pline = make_xy_planes(pts)
    else:
        planes, pline = make_planes_from_polyline(
            crv,
            pts,
            angle_limit=45.0,
            x_angle_limit=40.0,
            look_ahead=1.0
        )

    my_way_planes.extend(planes)
    plane_polylines.append(pline)


A = my_way_planes
B = plane_polylines
# ---------- end curve_to_planes_polyline ----------
pln_2 = Plane(curve_to_planes_polyline.my_way_planes)
crv = Curve(curve_to_planes_polyline.plane_polylines)

# ----
# Generate Planes
curve_to_planes_polyline_2 = Python3Script(C=move.Geometry, xyplane_printing=Toggle(False))  # -> out, my_way_planes, plane_polylines; inputs C: Curve, xyplane_printing: Boolean
# ---------- curve_to_planes_polyline_2: Python ----------
import Rhino.Geometry as rg
import math


def as_list(x):
    return [] if x is None else x if isinstance(x, list) else [x]


def safe_unit(v, fallback):
    v = rg.Vector3d(v)
    if v.Length < 0.001:
        v = rg.Vector3d(fallback)
    v.Unitize()
    return v


def get_polyline_pts(crv):
    if isinstance(crv, rg.Polyline):
        return list(crv)

    ok, pl = crv.TryGetPolyline()
    if ok:
        return list(pl)

    return []


def get_tangent(pts, i):
    if len(pts) < 2:
        return rg.Vector3d.XAxis

    if i == 0:
        v = pts[1] - pts[0]
    else:
        v = pts[i] - pts[i - 1]

    return safe_unit(v, rg.Vector3d.XAxis)


def angle_to_xy(v):
    v = safe_unit(v, rg.Vector3d.XAxis)
    return math.degrees(math.asin(abs(v.Z)))


def make_planes_xyplane(pts):
    planes = []

    for i, pt in enumerate(pts):
        plane = rg.Plane.CreateFromNormal(pt,rg.Vector3d(0,0,1))
        planes.append(plane)

    return planes, rg.Polyline(pts)


def make_planes_from_polyline(pts, angle_limit=45.0):
    planes = []

    for i, pt in enumerate(pts):
        tangent = get_tangent(pts, i)

        if angle_to_xy(tangent) > angle_limit:
            zaxis = rg.Vector3d(tangent)

            if zaxis.Z < 0:
                zaxis *= -1

            xaxis = rg.Vector3d.CrossProduct(rg.Vector3d.ZAxis, zaxis)

            if xaxis.Length < 0.001:
                xaxis = rg.Vector3d.XAxis

            xaxis.Unitize()
            yaxis = rg.Vector3d.CrossProduct(zaxis, xaxis)
            yaxis.Unitize()

            plane = rg.Plane(pt, xaxis, yaxis)

        else:
            plane = rg.Plane(pt, rg.Vector3d.XAxis, rg.Vector3d.YAxis)

        if plane.ZAxis.Z < 0:
            plane.Flip()

        planes.append(plane)

    return planes, rg.Polyline(pts)


my_way_planes = []
plane_polylines = []

for crv in as_list(C):
    pts = get_polyline_pts(crv)

    if xyplane_printing:
        planes, pline = make_planes_xyplane(pts)
    else:
        planes, pline = make_planes_from_polyline(pts, angle_limit=45.0)
    

    my_way_planes.extend(planes)
    plane_polylines.append(pline)
# ---------- end curve_to_planes_polyline_2 ----------
pln_3 = Plane(curve_to_planes_polyline_2.my_way_planes)
crv_2 = Curve(curve_to_planes_polyline_2.plane_polylines)

curve_to_planes__non_planar = Python3Script(C=move.Geometry, point_spacing=Slider(120, range=0..600))  # -> out, my_way_planes; inputs C: Curve, S: Surface, point_spacing: Double
# ---------- curve_to_planes__non_planar: Python ----------
import Rhino.Geometry as rg
import math


def as_list(x):
    if x is None:
        return []
    return x if isinstance(x, (list, tuple)) else [x]


def divide_crv(crv, spacing):
    length = crv.GetLength()
    if length <= 0 or spacing <= 0:
        return []

    pts = []
    count = int(math.ceil(length / spacing))

    for i in range(count + 1):
        d = min(i * spacing, length)
        ok, t = crv.LengthParameter(d)
        if ok:
            pts.append(crv.PointAt(t))

    return pts


def safe_unit(v, fallback): # unitize vector
    v = rg.Vector3d(v)

    if v.Length < 0.001:
        v = rg.Vector3d(fallback)

    v.Unitize()
    return v


def get_xaxis(pts, i):
    if len(pts) < 2:
        return rg.Vector3d(1, 0, 0)

    if i == 0:
        xaxis = pts[1] - pts[0]
    else:
        xaxis = pts[i] - pts[i - 1]

    return safe_unit(xaxis, rg.Vector3d(1, 0, 0))


def make_planar_planes(pts, curve, flip=False):
    planes = []

    for i, pt in enumerate(pts):
        plane = rg.Plane.CreateFromNormal(pt,rg.Vector3d(0,0,1))
        planes.append(plane)

    return planes


def make_nonplanar_planes(pts, curve, surface, flip=False):
    planes = []

    for pt in pts:
        ok, t = curve.ClosestPoint(pt)
        xaxis = curve.TangentAt(t) if ok else rg.Vector3d(1, 0, 0)
        xaxis = safe_unit(xaxis, rg.Vector3d(1, 0, 0))

        ok, u, v = surface.ClosestPoint(pt)
        yaxis = surface.NormalAt(u, v) if ok else rg.Vector3d(0, 0, 1)
        yaxis = safe_unit(yaxis, rg.Vector3d(0, 0, 1))
        
        if flip:
            yaxis *= -1

        zaxis = rg.Vector3d.CrossProduct(xaxis, yaxis)
        zaxis = safe_unit(zaxis, rg.Vector3d(0, 1, 0))

        yaxis = rg.Vector3d.CrossProduct(zaxis, xaxis)
        yaxis = safe_unit(yaxis, rg.Vector3d(0, 0, 1))

        planes.append(rg.Plane(pt, xaxis, yaxis))

    return planes


nonplanar = False
my_way_planes = []

for crv in as_list(C):
    pts = divide_crv(crv, point_spacing)

    if nonplanar and S:
        my_way_planes.extend(make_nonplanar_planes(pts, crv, S, flip=False)) # C: single curve
    else:
        my_way_planes.extend(make_planar_planes(pts, crv, flip=True))
# ---------- end curve_to_planes__non_planar ----------
pln_4 = Plane(curve_to_planes__non_planar.my_way_planes)
pline = PolyLine(Vertices=pln_4, Closed=False)

curve_to_planes_polyline_3 = Python3Script(C=move.Geometry, xyplane_printing=Toggle(False))  # -> out, my_way_planes, plane_polylines; inputs C: Curve, xyplane_printing: Boolean
# ---------- curve_to_planes_polyline_3: Python ----------
import Rhino.Geometry as rg
import math


def as_list(x):
    return [] if x is None else x if isinstance(x, (list, tuple)) else [x]


def safe_unit(v, fallback):
    v = rg.Vector3d(v)
    if v.Length < 0.001:
        v = rg.Vector3d(fallback)
    v.Unitize()
    return v


def get_polyline_pts(crv):
    if isinstance(crv, rg.Polyline):
        return list(crv)

    ok, pl = crv.TryGetPolyline()
    return list(pl) if ok else []


def get_tangent_ahead(crv, pt, look_ahead):
    ok, t = crv.ClosestPoint(pt)
    if not ok:
        return rg.Vector3d.XAxis

    current_len = crv.GetLength(rg.Interval(crv.Domain.T0, t))
    target_len = min(current_len + look_ahead, crv.GetLength())

    ok, t2 = crv.LengthParameter(target_len)
    if not ok:
        return rg.Vector3d.XAxis

    return safe_unit(crv.PointAt(t2) - pt, rg.Vector3d.XAxis)


def angle_to_xy(v):
    v = safe_unit(v, rg.Vector3d.XAxis)
    return math.degrees(math.asin(abs(v.Z)))


def angle_between(v1, v2):
    v1 = safe_unit(v1, rg.Vector3d.XAxis)
    v2 = safe_unit(v2, rg.Vector3d.XAxis)
    dot = max(-1.0, min(1.0, v1 * v2))
    return math.degrees(math.acos(dot))


def rotate_plane_90_best_match(plane, prev_plane):
    """
    Try rotating current plane +90 or -90 degrees around its own ZAxis.
    Keep the version whose XAxis is closer to previous plane XAxis.
    """

    p_plus = rg.Plane(plane)
    p_minus = rg.Plane(plane)

    p_plus.Rotate(math.radians(90), p_plus.ZAxis, p_plus.Origin)
    p_minus.Rotate(math.radians(-90), p_minus.ZAxis, p_minus.Origin)

    a0 = angle_between(plane.XAxis, prev_plane.XAxis)
    a1 = angle_between(p_plus.XAxis, prev_plane.XAxis)
    a2 = angle_between(p_minus.XAxis, prev_plane.XAxis)

    if a1 <= a0 and a1 <= a2:
        return p_plus
    elif a2 <= a0 and a2 <= a1:
        return p_minus
    else:
        return plane


def make_xy_planes(pts):
    planes = [rg.Plane.CreateFromNormal(pt, rg.Vector3d.ZAxis) for pt in pts]
    return planes, rg.Polyline(pts)


def make_planes_from_polyline(crv, pts, angle_limit=45.0, x_angle_limit=80.0, look_ahead=1.0):
    planes = []

    for pt in pts:
        tangent = get_tangent_ahead(crv, pt, look_ahead)

        if angle_to_xy(tangent) > angle_limit:
            zaxis = rg.Vector3d(tangent)

            if zaxis.Z < 0:
                zaxis *= -1

            xaxis = rg.Vector3d.CrossProduct(rg.Vector3d.ZAxis, zaxis)

            if xaxis.Length < 0.001:
                xaxis = rg.Vector3d.XAxis

            xaxis.Unitize()

            yaxis = rg.Vector3d.CrossProduct(zaxis, xaxis)
            yaxis.Unitize()

            plane = rg.Plane(pt, xaxis, yaxis)

        else:
            plane = rg.Plane(pt, rg.Vector3d.XAxis, rg.Vector3d.YAxis)

        if plane.ZAxis.Z < 0:
            plane.Flip()

        # If current XAxis differs too much from previous XAxis,
        # rotate current plane 90 degrees around its own ZAxis.
        if planes:
            x_angle = angle_between(plane.XAxis, planes[-1].XAxis)

            if x_angle > x_angle_limit:
                plane = rotate_plane_90_best_match(plane, planes[-1])

        planes.append(plane)

    return planes, rg.Polyline(pts)


my_way_planes = []
plane_polylines = []

for crv in as_list(C):
    pts = get_polyline_pts(crv)

    if xyplane_printing:
        planes, pline = make_xy_planes(pts)
    else:
        planes, pline = make_planes_from_polyline(
            crv,
            pts,
            angle_limit=45.0,
            x_angle_limit=80.0,
            look_ahead=1.0
        )

    my_way_planes.extend(planes)
    plane_polylines.append(pline)


A = my_way_planes
B = plane_polylines
# ---------- end curve_to_planes_polyline_3 ----------
pln_5 = Plane(curve_to_planes_polyline_3.my_way_planes)
crv_3 = Curve(curve_to_planes_polyline_3.plane_polylines)

# ----
# Generate Planes
curve_to_planes_polyline_4 = Python3Script(C=move.Geometry, xyplane_printing=Toggle(False))  # -> out, my_way_planes, plane_polylines; inputs C: Curve, xyplane_printing: Boolean
# ---------- curve_to_planes_polyline_4: Python ----------
import Rhino.Geometry as rg
import math


def as_list(x):
    return [] if x is None else x if isinstance(x, (list, tuple)) else [x]


def safe_unit(v, fallback):
    v = rg.Vector3d(v)
    if v.Length < 0.001:
        v = rg.Vector3d(fallback)
    v.Unitize()
    return v


def get_polyline_pts(crv):
    if isinstance(crv, rg.Polyline):
        return list(crv)

    ok, pl = crv.TryGetPolyline()
    return list(pl) if ok else []


def get_tangent_ahead(crv, pt, look_ahead):
    ok, t = crv.ClosestPoint(pt)
    if not ok:
        return rg.Vector3d.XAxis

    current_len = crv.GetLength(rg.Interval(crv.Domain.T0, t))
    target_len = min(current_len + look_ahead, crv.GetLength())

    ok, t2 = crv.LengthParameter(target_len)
    if not ok:
        return rg.Vector3d.XAxis

    return safe_unit(crv.PointAt(t2) - pt, rg.Vector3d.XAxis)


def angle_to_xy(v):
    v = safe_unit(v, rg.Vector3d.XAxis)
    return math.degrees(math.asin(abs(v.Z)))


def is_xy_plane(plane, tol=0.001):
    return abs(plane.ZAxis * rg.Vector3d.ZAxis - 1.0) < tol


def same_axes_at_point(prev_plane, pt):
    return rg.Plane(pt, prev_plane.XAxis, prev_plane.YAxis)


def make_xy_planes(pts):
    planes = [rg.Plane(pt, rg.Vector3d.XAxis, rg.Vector3d.YAxis) for pt in pts]
    return planes, rg.Polyline(pts)


def make_planes_from_polyline(crv, pts, angle_limit=45.0, look_ahead=1.0):
    planes = []

    for pt in pts:
        tangent = get_tangent_ahead(crv, pt, look_ahead)

        if angle_to_xy(tangent) > angle_limit:
            zaxis = rg.Vector3d(tangent)

            if zaxis.Z < 0:
                zaxis *= -1

            xaxis = rg.Vector3d.CrossProduct(rg.Vector3d.ZAxis, zaxis)
            if xaxis.Length < 0.001:
                xaxis = rg.Vector3d.XAxis

            xaxis.Unitize()
            yaxis = rg.Vector3d.CrossProduct(zaxis, xaxis)
            yaxis.Unitize()

            plane = rg.Plane(pt, xaxis, yaxis)

        else:
            plane = rg.Plane(pt, rg.Vector3d.XAxis, rg.Vector3d.YAxis)

        if plane.ZAxis.Z < 0:
            plane.Flip()

        # If previous plane and current plane are both XY planes,
        # keep the same frame orientation as previous plane.
        if planes and is_xy_plane(planes[-1]) and is_xy_plane(plane):
            plane = same_axes_at_point(planes[-1], pt)

        planes.append(plane)

    return planes, rg.Polyline(pts)


my_way_planes = []
plane_polylines = []

for crv in as_list(C):
    pts = get_polyline_pts(crv)

    if xyplane_printing:
        planes, pline = make_xy_planes(pts)
    else:
        planes, pline = make_planes_from_polyline(
            crv,
            pts,
            angle_limit=45.0,
            look_ahead=1.0
        )

    my_way_planes.extend(planes)
    plane_polylines.append(pline)
# ---------- end curve_to_planes_polyline_4 ----------
pln_6 = Plane(curve_to_planes_polyline_4.my_way_planes)
crv_4 = Curve(curve_to_planes_polyline_4.plane_polylines)

replace = ReplaceItems(List=pln_2, Item=pln, Indices=Slider(8, range=0..10), Wrap=False)

explode = Explode(Curve=crv, Recursive=True)  # -> Segments, Vertices
series = Series(Start=0, Step=1, Count=Slider(6, range=0..11))
points_5 = PointList(Points=explode.Vertices, Size=10)
item = ListItem(List=explode.Vertices, Index=series, Wrap=True)
item_2 = ListItem(List=explode.Segments, Index=Slider(0, range=0..11), Wrap=True)
pline_2 = PolyLine(Vertices=item, Closed=False)

shift = ShiftList(List=pln_2, Shift=1, Wrap=invert(True))
cull_i = CullIndex(List=pln_2, Indices="-1", Wrap=True)
stack = StackTrees(Data0=cull_i, Data1=shift, Data2=explode.Segments, Reduce=True)
item_3 = ListItem(List=stack, Index=Slider(7, range=0..11), Wrap=True)

explode_2 = Explode(Curve=crv, Recursive=True)  # -> Segments, Vertices

shift_2 = ShiftList(List=pln_2, Shift=1, Wrap=invert(True))
cull_i_2 = CullIndex(List=pln_2, Indices="-1", Wrap=True)
stack_2 = StackTrees(Data0=cull_i_2, Data1=shift_2, Data2=explode_2.Segments, Reduce=True)
item_4 = ListItem(List=stack_2, Index=Slider(4, range=0..10), Wrap=True)

shift_3 = ShiftList(List=pln_3, Shift=1, Wrap=invert(True))  # disabled
number_slider_5 = Slider(8, range=0..11)  # disabled
explode_3 = Explode(Curve=crv_2, Recursive=True)  # -> Segments, Vertices; disabled
stack_3 = StackTrees(Data0=pln_3, Data1=shift_3, Data2=explode_3.Segments, Reduce=True)  # disabled
item_5 = ListItem(List=stack_3, Index=number_slider_5, Wrap=True)  # disabled

plane = Plane()
points_6 = PointList(Points=pln_2, Size=10)
polyline = PolyLine(Closed=False)

# ---- group: Preview
colour_swatch = ColourSwatch(SwatchColor=RGB(0, 254, 0))
polyline_2 = PolyLine(Vertices=plane, Closed=False)
cylinder = Cylinder(Base=PlaneXY(0, 0, 0), Radius=Slider(25, range=0..100), Length=Slider(40, range=0..100))
rectangle_3pt = Rectangle3Pt()  # -> graft(Rectangle), Length
custom_preview_lineweights = CustomPreviewLineweights(Geometry=polyline, Shader=colour_swatch, Thickness=Slider(5, range=0..10), Absolute=False)
plane_2 = Plane(plane)
deconstruct_plane = DeconstructPlane(Plane=plane_2)  # -> Origin, XAxis, YAxis, ZAxis
vector_display = VectorDisplay(Anchor=deconstruct_plane.Origin, Vector=deconstruct_plane.XAxis)
point_list = PointList(Points=plane, Size=Slider(3, range=0..10))
custom_preview = CustomPreview(
    Geometry=rectangle_3pt.Rectangle,
    Material=[colour_swatch, ColourSwatch(SwatchColor=RGB(255, 0, 0)), ColourSwatch(SwatchColor=RGB(0, 0, 255)), ColourSwatch(SwatchColor=RGB(0, 254, 255))])

# ----
item_6 = ListItem(List=flatten(item_3), Index=0, Wrap=True)  # -> Item, Item1
item_7 = ListItem(List=flatten(item_4), Index=0, Wrap=True)  # -> Item, Item1
deplane = DeconstructPlane(Plane=item_6.Item1)  # -> Origin, XAxis, YAxis, ZAxis
deplane_2 = DeconstructPlane(Plane=item_7.Item1)  # -> Origin, XAxis, YAxis, ZAxis

# ----
# Generate URscript
pln_7 = Plane(pln_2)
number_slider_6 = Slider(1, range=0..2)
number_slider_7 = Slider(0.1, range=0..1)
plane_tcp_to_urscript = Python3Script(
    way_planes=pln_7,
    tcp_measured="{0, 0, 0}",
    radius=Slider(9, range=0..20),
    acceleration=number_slider_6,
    velocity=number_slider_7)  # -> out, script; inputs way_planes: list of Plane, tcp_measured: Point3d, radius: Double, acceleration: Double, velocity: Double
# ---------- plane_tcp_to_urscript: Python ----------
from imp import reload
import sys

sys.path.append("C:\\Users\\user\\github\\F3DP\\01 tamplate\\02_RoboticDrawing\\src")


import simple_ur_script as ur
reload(ur)

import utils 
reload(utils)

import simple_comm as com
reload(com)

import Rhino.Geometry as rg
import math as m

script = "" #create empty string

#if value given for tcp measured, then add line to script, otherwise it will take current tcp from robot
if tcp_measured is not None:
    script += ur.set_tcp_by_angles(tcp_measured.X, tcp_measured.Y, tcp_measured.Z, m.radians(-90.0),m.radians(-90.0),m.radians(0))

#calculate blend
blend_radii = utils.calculate_blend_radius(way_planes, radius=radius)
#add move_l commands to script for each way plane
for plane, radius in zip(way_planes, blend_radii):
    script += ur.move_l_blend(plane, acceleration, velocity, radius)


#format the script to make it sendable
script = com.concatenate_script(script)
# ---------- end plane_tcp_to_urscript ----------
panel_2 = Panel(plane_tcp_to_urscript.script)

item_8 = ListItem(List=pln_2, Index=Slider(5, range=0..11), Wrap=True)
rot3d = Rotate3D(Geometry=item_6.Item1, Angle=degrees("-90"), Center=item_6.Item1, Axis=deplane.ZAxis)  # -> Geometry, Transform
rot3d_2 = Rotate3D(Geometry=item_7.Item1, Angle=degrees("-90"), Center=item_7.Item1, Axis=deplane_2.ZAxis)  # -> Geometry, Transform
pln_8 = Plane(rot3d.Geometry)
pln_9 = Plane(rot3d_2.Geometry)
replace_2 = ReplaceItems(List=pln_2, Item=rot3d_2.Geometry, Indices=Slider(8, range=0..10), Wrap=False)
explode_4 = Explode(Curve=crv, Recursive=True)  # -> Segments, Vertices

shift_4 = ShiftList(List=replace_2, Shift=1, Wrap=invert(True))
cull_i_3 = CullIndex(List=replace_2, Indices="-1", Wrap=True)
stack_4 = StackTrees(Data0=cull_i_3, Data1=shift_4, Data2=explode_4.Segments, Reduce=True)
item_9 = ListItem(List=stack_4, Index=Slider(5, range=0..11), Wrap=True)

# ---- group: Send UR script to Robot!
py3_5 = Python3Script(script=plane_tcp_to_urscript.script, ip_address="192.168.10.10", send=Button())  # -> out, a; inputs script: String, ip_address: String, send: Boolean
# ---------- py3_5: Python ----------
import simple_comm as com

if send:
    com.send_script(script,ip_address)
# ---------- end py3_5 ----------
