# Grasshopper definition spatial_printing_tests.gh (Grasshopper 1.0.8)
# plug-ins: Robots

# ---- group: Mixer
geo = Geometry(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)
pt = Point(Point(0, 452.5, 120))

# ----
pl = ConstructPlane(Origin=pt, XAxis="{0,0,1}", YAxis="{1,0,0}")

# ---- group: Sim
create_tool = CreateTool(Name="PU_Mixer", TCP=pl, Weight=Slider(2, range=0..100), Mesh=geo)  # -> Tool, TCP

# ----
panel = Panel(".7")
panel_2 = Panel("4")
py3 = Python3Script(radius="150", num=Slider(3, range=0..10))  # -> out, my_test, middle, points, my_mesh, my_mesh_2, curves, planes; inputs radius: Double, num: Int32
# ---------- py3: Python ----------
import os, sys, importlib
import Rhino.Geometry as rg # type: ignore
import rhinoscriptsyntax as rs # type: ignore
import math 
# from compas_rhino import unload_modules


gh_dir = os.path.dirname(ghenv.Component.OnPingDocument().FilePath)
sys.path.append(gh_dir)
# print(gh_dir)

import experiments

importlib.reload(experiments)

from experiments import exp_01, create_mesh, build_graph, exp_02, exp_03, print_path, create_trig_curve, create_trig_spiral_with_planes, create_vertical_spatial_bulb

############--------Main Code----------#########
my_test, middle, points = exp_01(radius, num)
my_mesh, edges = create_mesh()
# p_mesh, mesh = exp_02()
my_mesh = exp_03(radius, num)
ng = build_graph(radius, num)
path = print_path(radius, num)

curves, planes = create_trig_curve(type="sine", wavelength=150.0, amplitude=20.0, num_cycles=3, samples_per_cycle=8)

# crv, planes = create_trig_spiral_with_planes(radius=50.0, pitch=300.0, num_turns=2, amp=10.0, freq=10.0, planes_num=10)

# curves, planes = create_vertical_spatial_bulb(target_height=600.0, amp=10.0, freq=10.0, samples=10, num=num, radius=radius)


########--------Output Data---------#########


#############-----------Print----------##########
# print(my_test)
# print(*edges)
# print(ng)
# print(s_mesh)
# print(path)
print(my_mesh)
print(*path.nodes_attributes())
# print(len(rg_points))
# ---------- end py3 ----------
py3_2 = Python3Script(radius="100", num=Slider(3, range=0..10))  # -> out, my_test, middle, points, my_mesh, my_mesh_2, curves, planes; inputs radius: Double, num: Int32
# ---------- py3_2: Python ----------
import os, sys, importlib
import Rhino.Geometry as rg # type: ignore
import rhinoscriptsyntax as rs # type: ignore
import math 
# from compas_rhino import unload_modules


gh_dir = os.path.dirname(ghenv.Component.OnPingDocument().FilePath)
sys.path.append(gh_dir)
# print(gh_dir)

import experiments

importlib.reload(experiments)

from experiments import exp_01, create_mesh, build_graph, exp_02, exp_03, print_path, create_trig_curve, create_trig_spiral_with_planes, create_vertical_spatial_bulb

############--------Main Code----------#########
my_test, middle, points = exp_01(radius, num)
my_mesh, edges = create_mesh()
# p_mesh, mesh = exp_02()
my_mesh = exp_03(radius, num)
ng = build_graph(radius, num)
path = print_path(radius, num)

# curve, planes = create_trig_curve(type="sine", wavelength=150.0, amplitude=15.0, num_cycles=2, samples_per_cycle=10)

# crv, planes = create_trig_spiral_with_planes(radius=50.0, pitch=300.0, num_turns=2, amp=10.0, freq=10.0, planes_num=10)

curves, planes = create_vertical_spatial_bulb(target_height=500.0, amp=20.0, freq=1.0, samples=10, num=num, radius=100, spiral_turns=.25)


########--------Output Data---------#########


#############-----------Print----------##########
# print(my_test)
# print(*edges)
# print(ng)
# print(s_mesh)
# print(path)
print(my_mesh)
print(*path.nodes_attributes())
# print(len(rg_points))
# ---------- end py3_2 ----------
py3_3 = Python3Script(radius="100", num=Slider(3, range=0..10))  # -> out, my_test, middle, points, my_mesh, my_mesh_2, curves, planes; inputs radius: Double, num: Int32
# ---------- py3_3: Python ----------
import os, sys, importlib
import Rhino.Geometry as rg # type: ignore
import rhinoscriptsyntax as rs # type: ignore
import math 
# from compas_rhino import unload_modules


gh_dir = os.path.dirname(ghenv.Component.OnPingDocument().FilePath)
sys.path.append(gh_dir)
# print(gh_dir)

import experiments

importlib.reload(experiments)

from experiments import exp_01, create_mesh, build_graph, exp_02, exp_03, print_path, create_trig_curve, create_trig_spiral_with_planes, create_vertical_spatial_bulb, create_vertical_spatial_bulb

############--------Main Code----------#########
my_test, middle, points = exp_01(radius, num)
my_mesh, edges = create_mesh()
# p_mesh, mesh = exp_02()
my_mesh = exp_03(radius, num)
ng = build_graph(radius, num)
path = print_path(radius, num)

# curve, planes = create_trig_curve(type="sine", wavelength=150.0, amplitude=15.0, num_cycles=2, samples_per_cycle=10)

# crv, planes = create_trig_spiral_with_planes(radius=50.0, pitch=300.0, num_turns=2, amp=10.0, freq=10.0, planes_num=10)

curves, planes = create_vertical_spatial_bulb(target_height=400.0, amp=40.0, freq=4.0, samples=60, num=3, radius=100, spiral_turns=0.5)


########--------Output Data---------#########


#############-----------Print----------##########
# print(my_test)
# print(*edges)
# print(ng)
# print(s_mesh)
# print(path)
print(my_mesh)
print(*path.nodes_attributes())
# print(len(rg_points))
# ---------- end py3_3 ----------
py3_4 = Python3Script(radius="200", num=Slider(3, range=0..10))  # -> out, my_test, middle, points, my_mesh, my_mesh_2, curves, planes; inputs radius: Double, num: Int32
# ---------- py3_4: Python ----------
import os, sys, importlib
import Rhino.Geometry as rg # type: ignore
import rhinoscriptsyntax as rs # type: ignore
import math 
# from compas_rhino import unload_modules


gh_dir = os.path.dirname(ghenv.Component.OnPingDocument().FilePath)
sys.path.append(gh_dir)
# print(gh_dir)

import experiments

importlib.reload(experiments)

from experiments import exp_01, create_mesh, build_graph, exp_02, exp_03, print_path, create_trig_curve, create_trig_spiral_with_planes, create_vertical_spatial_bulb

############--------Main Code----------#########
my_test, middle, points = exp_01(radius, num)
my_mesh, edges = create_mesh()
# p_mesh, mesh = exp_02()
my_mesh = exp_03(radius, num)
ng = build_graph(radius, num)
path = print_path(radius, num)

# curves, planes = create_trig_curve(type="sine", wavelength=150.0, amplitude=15.0, num_cycles=2, samples_per_cycle=10)

curves, planes = create_trig_spiral_with_planes(radius=30.0, pitch=200.0, num_turns=1, amp=10.0, freq=1.0, planes_num=20)

# curves, planes = create_vertical_spatial_bulb(target_height=600.0, amp=10.0, freq=10.0, samples=10, num=num, radius=radius)


########--------Output Data---------#########


#############-----------Print----------##########
# print(my_test)
# print(*edges)
# print(ng)
# print(s_mesh)
# print(path)
print(my_mesh)
print(*path.nodes_attributes())
# print(len(rg_points))
# ---------- end py3_4 ----------
pt_2 = Point(Point(649.1929421, -373.0766107, 0))
pt_3 = Point(pt_2)
pt_4 = Point(Point(650.4421574, -212.7411771, 0))
draw = COMPASDraw(cg=py3.my_test)  # -> rg
#   port cg: The COMPAS geometry or datastructure to be drawn.
#   port rg: The Rhino geometry object.
# ---------- draw: Python ----------
# r: compas>=2.14.1
"""
Draws COMPAS geometry in Grasshopper.
"""

from typing import Any

import Grasshopper

from compas.scene import SceneObject


class CompasToRhinoGeometry(Grasshopper.Kernel.GH_ScriptInstance):
    def RunScript(self, cg):
        if not cg:
            return None

        return SceneObject(item=cg).draw()
# ---------- end draw ----------
draw_2 = COMPASDraw(cg=py3.middle)  # -> rg; same code as draw
draw_3 = COMPASDraw(cg=py3.points)  # -> rg; same code as draw
draw_4 = COMPASDraw(cg=py3.my_mesh_2)  # -> rg; same code as draw
draw_5 = COMPASDraw(cg=py3_2.my_test)  # -> rg; same code as draw
draw_6 = COMPASDraw(cg=py3_2.middle)  # -> rg; same code as draw
draw_7 = COMPASDraw(cg=py3_2.points)  # -> rg; same code as draw
draw_8 = COMPASDraw(cg=py3_2.my_mesh_2)  # -> rg; same code as draw
draw_9 = COMPASDraw(cg=py3_3.my_test)  # -> rg; same code as draw
draw_10 = COMPASDraw(cg=py3_3.middle)  # -> rg; same code as draw
draw_11 = COMPASDraw(cg=py3_3.points)  # -> rg; same code as draw
draw_12 = COMPASDraw(cg=py3_3.my_mesh_2)  # -> rg; same code as draw
draw_13 = COMPASDraw(cg=py3_4.my_test)  # -> rg; same code as draw
draw_14 = COMPASDraw(cg=py3_4.middle)  # -> rg; same code as draw
draw_15 = COMPASDraw(cg=py3_4.points)  # -> rg; same code as draw
draw_16 = COMPASDraw(cg=py3_4.my_mesh_2)  # -> rg; same code as draw
points = PointList(Points=draw_3, Size=10)
faceb = FaceBoundaries(Mesh=draw_4)
faceb_2 = FaceBoundaries(Mesh=draw_8)
faceb_3 = FaceBoundaries(Mesh=draw_12)
points_2 = PointList(Points=draw_15, Size=10)
faceb_4 = FaceBoundaries(Mesh=draw_16)
points_3 = PointList(Points=py3_2.planes, Size=10)
points_4 = PointList(Points=py3_3.planes, Size=10)
vec = VectorXYZ(XComponent=Slider(650, range=0..1000), YComponent=0, ZComponent=Slider(32, range=0..100))  # -> Vector, Length
pln = Plane([PlaneXY(0, 300, 10), PlaneXY(0, 0, 0), Plane(origin=(30, 0, 100), x=(0.9739875902, -0.1596753196, -0.1607854669), y=(0, 0.7095520983, -0.7046529783)), Plane(origin=(28.43549244, 22.37996191, 121.2223906), x=(0.9433821839, 0.2399838452, 0.2289930331), y=(0, 0.6903456684, -0.7234796875)), Plane(origin=(10.88241132, 38.09093012, 141.1421506), x=(0.6794422849, 0.2865586957, 0.6754571011), y=(0, 0.9205812244, -0.3905511609)), Plane(origin=(-12.97734718, 37.24712162, 160.6718477), x=(0.7023589995, -0.3211493307, 0.6352597447), y=(0, 0.8924407292, 0.4511646539))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])
move = Move(Geometry=pln, Motion=vec.Vector)  # -> Geometry, Transform
pipe = Pipe(Curve=py3.curves, Radius="23", Caps=0, FitRail=False)
pipe_2 = Pipe(Curve=py3_4.curves, Radius="23", Caps=0, FitRail=False)
pln_2 = Plane([PlaneXY(650, 300, 42), PlaneXY(650, 0, 32), Plane(origin=(680, 0, 132), x=(0.9992889428, 0.02730384468, 0.02600209232), y=(0, 0.6896333472, -0.7241587164)), Plane(origin=(665.9507895, 25.38466743, 164.2339524), x=(0.8118838631, 0.2641052851, 0.5206659113), y=(0, 0.8918276653, -0.4523753037)), Plane(origin=(636.9255821, 26.99037027, 196.3664333), x=(0.7876262434, -0.2350947761, 0.5695395921), y=(0, 0.9243472093, 0.3815524034)), Plane(origin=(620.1811243, 3.254804002, 228.5367279), x=(0.9971255288, -0.05178236992, 0.0553106325), y=(0, 0.7300068899, 0.6834397857))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])
panel_6 = Panel("-100")
X = UnitX(Factor="100")
Y = UnitY(Factor="100")
move_2 = Move(Geometry=pt_3, Motion=X)  # -> Geometry, Transform
move_3 = Move(Geometry=pt_3, Motion=Y)  # -> Geometry, Transform
Z = UnitZ(Factor="10")
move_4 = Move(Geometry=pt_3, Motion=Z)  # -> Geometry, Transform
move_5 = Move(Geometry=move_2.Geometry, Motion=Z)  # -> Geometry, Transform
move_6 = Move(Geometry=move_3.Geometry, Motion=Z)  # -> Geometry, Transform
pt_5 = Point(move_4.Geometry)
pt_6 = Point(move_5.Geometry)
pt_7 = Point(move_6.Geometry)

# ----
# Transform from Rhino to Robot Space
pln_3 = Plane(py3_4.planes)
fine_adjust_z_mm = Slider(0.8, range=-5..10)
pt_8 = ConstructPoint(XCoordinate="535.90", YCoordinate="101.40", ZCoordinate="-9.39")
pt_9 = ConstructPoint(XCoordinate="246.86", YCoordinate="-314.78", ZCoordinate="-10.85")
pt_10 = ConstructPoint(XCoordinate="534.35", YCoordinate="-315.60", ZCoordinate="-9.96")
rhino = Python3Script(way_planes=pln_3, wobj_origin=pt_5, wobj_xaxis=pt_6, wobj_xypoint=pt_7, z_safe_margin=fine_adjust_z_mm)  # -> out, transformed_planes, curves; inputs way_planes: list of Plane, wobj_origin: Point3d, wobj_xaxis: Point3d, wobj_xypoint: Point3d, z_safe_margin: Double, curves: list of Curve
# ---------- rhino: Python ----------
import Rhino.Geometry as rg
import math

def set_robot_base(origin, xaxis, xypoint):
    return rg.Plane(origin, xaxis - origin, xypoint - origin)

# def rhino_to_robot_space(rhino_plane, robot_base_plane):
#     T = rg.Transform.PlaneToPlane(rg.Plane.WorldXY, robot_base_plane)
#     robot_plane = rhino_plane.Clone()
#     robot_plane.Transform(T)
#     return robot_plane

def rhino_to_robot_space(rhino_plane, robot_base_plane, flip_z=False):
    T = rg.Transform.PlaneToPlane(rg.Plane.WorldXY, robot_base_plane)
    robot_plane = rhino_plane.Clone()

    if flip_z:
        R = rg.Transform.Rotation(math.pi, robot_plane.XAxis, robot_plane.Origin)
        robot_plane.Transform(R)

    robot_plane.Transform(T)
    return robot_plane

def set_z_safe_margin(planes, safety_margin):
    adjusted = []

    for plane in planes:
        p = plane.Clone()
        p.OriginZ += safety_margin
        adjusted.append(p)

    return adjusted

flip_z = True

robot_base = set_robot_base(wobj_origin, wobj_xaxis, wobj_xypoint)

safer_planes = set_z_safe_margin(way_planes, z_safe_margin)

transformed_planes = []
curves = curves
# for curve in curves:
#     rhino_to_robot_space(curve, robot_base, flip_z)

for plane in safer_planes:
    transformed_planes.append(rhino_to_robot_space(plane, robot_base, flip_z))
# ---------- end rhino ----------
points_5 = PointList(Points=rhino.transformed_planes, Size=10)

# ---- group: Sim
robots_library = RobotsLibrary({"UR3e", "UR5e", "UR10e", "UR16e", "UR3", "UR5", "UR10", "UR20", "UR30"}, selected="UR10", Type=0)
load_robot_system = LoadRobotSystem(Name=robots_library, Base=PlaneXY(0, 0, 0))
number_slider = Slider(0.865, range=0..1)
createtarget = CreateTarget(Plane=rhino.transformed_planes, Tool=create_tool.Tool, IsCartesian=True)
create_program = CreateProgram(Name="DefaultProgram", RobotSystem=load_robot_system, Targets=createtarget, StepSize=1)  # -> Program, Code, Duration, Warnings, Errors
program_simulation = ProgramSimulation(Program=create_program.Program, Time=0, Normalized=True)  # -> SystemMeshes, JointRotations, Plane, Index, Time, Program, Errors
panel_7 = Panel(create_program.Warnings)
panel_8 = Panel(program_simulation.JointRotations)

# ----
pln_4 = Plane(program_simulation.Plane)
preview = CustomPreview(
    Geometry=program_simulation.SystemMeshes,
    Material={diffuse=RGB(221, 160, 221), emission=RGB(66, 48, 66), shine=0.5, specular=RGB(255, 255, 255), transparency=0})
pline = PolyLine(Vertices=rhino.transformed_planes, Closed=False)
pln_5 = Plane(rhino.transformed_planes)
pln_6 = Plane([Plane(origin=(650.4421574, 87.25882285, 20.8), x=(1, 0, 0), y=(0, -1, 0)), Plane(origin=(650.4421574, -192.7411771, 10.8), x=(1, 0, 0), y=(0, -1, 0)), Plane(origin=(650.4421574, -192.7411771, 60.8), x=(1, 0, 0), y=(0, -0.9716913389, 0.2362539774)), Plane(origin=(650.4421574, -194.2337221, 102.6768463), x=(1, 0, 0), y=(0, -0.9589880954, -0.2834463493)), Plane(origin=(650.4421574, -203.3713208, 143.9994303), x=(1, 0, 0), y=(0, -0.9999850365, 0.005470529965)), Plane(origin=(650.4421574, -188.8481123, 183.1580549), x=(1, 0, 0), y=(0, -0.8100964072, 0.586296692))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])
pipe_3 = Pipe(Curve=pline, Radius="23", Caps=0, FitRail=False)
cap = CapHoles(Brep=pipe_3)
preview_2 = CustomPreview(Geometry=cap, Material=ColourSwatch(SwatchColor=RGB(163, 163, 127)))
