# Grasshopper definition DEVELOPing_Bridging span_for chechking.gh (Grasshopper 1.0.8)
# plug-ins: Robots, treesloth01, NGon, Increment

wall_height = Slider(245, range=0..300)
wall_height_2 = Slider(90, range=0..100)

# ---- group: Robot Simulation
# TCP
pln_flange = Plane(Plane(origin=(0, 0, 0), x=(-0.9999872084, 0.005057970604, 0), y=(0.005057970604, 0.9999872084, 0)))
pln_tcp = Plane(Plane(origin=(1.978150976e-10, -452.5045299, 120), x=(0, 0, -1), y=(1, 0, 0)))
tool = Geometry(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)

# ----
panel = Panel("""2
7
10
15""")
panel_2 = Panel("""3
7
11
15""")
increment = Increment(BeginningNumber=Slider(63, range=0..100), StepSize=1, currentValue=71, increment=1, oldStart=63)  # -> Output, Item

fast = Panel("""3
8
13
18
23
28
33
38
67
68""")
slow = Panel("""57
60
63
66
69
72
75""")

fast_2 = Panel("""3
8
13
18
55
56
58
59
61
62
64
65
67
68
70
71
73
74
76
77
78""")

series = Series(Start=Slider(69, range=0..100), Step=Slider(3, range=0..10), Count=Slider(7, range=0..10))
addition = Addition(A=series, B="1")
addition_2 = Addition(A=addition, B="1")
item = ListItem(List=addition_2, Index=0, Wrap=True)  # -> Item1, Item
addition_3 = Addition(A=item.Item1, B="1")
panel_3 = Panel(series)
panel_4 = Panel(addition)
panel_5 = Panel(addition_2)
weave = Weave(Pattern=[0, 1], Stream0=addition, Stream1=addition_2, NullGaps=False)
merge = Merge(Data1=weave, Data2=addition_3)
merge_2 = Merge(Data1=fast, Data2=merge)  # -> flatten(Result)
panel_6 = Panel(merge_2)
number_slider = Slider(8, range=0..10)
series_2 = Series(Start=Slider(2, range=0..10), Step=Slider(3, range=0..10), Count=Slider(11, range=0..100))

X = UnitX(Factor=1)
Z = UnitZ(Factor=wall_height)
Z_2 = UnitZ(Factor=wall_height_2)
layer_height = Slider(12, range=0..30)
pt = ConstructPoint(XCoordinate=0, YCoordinate=0, ZCoordinate=layer_height)
line = LineSDL(Start=pt, Direction=X, Length=Slider(395, range=0..1000))
rotate = Rotate(Geometry=line, Angle=degrees(Slider(90, range=0..180)), Plane=PlaneXY(0, 0, 0))  # -> Geometry, Transform
extr = Extrude(Base=rotate.Geometry, Direction=Z_2)
extr_2 = Extrude(Base=line, Direction=Z)
join = BrepJoin(Breps=[extr_2, extr])  # -> Breps, Closed
contour = Contour(Shape=join.Breps, Point=pt, Direction=Vector(0, 0, 1), Distance=layer_height)  # -> flatten(Contours)
py3 = Python3Script(C=contour)  # -> out, curves, upper_crv, lower_crv; inputs C: list of Curve
# ---------- py3: Python ----------
def get_length(crv):
    return crv.GetLength() if hasattr(crv, "GetLength") else crv.Length


def get_left_segment(crv):
    segments = list(crv.DuplicateSegments())
    return min(
        segments,
        key=lambda seg: seg.PointAtNormalizedLength(0.5).X
    )


input_curves = list(C)
lengths = [get_length(crv) for crv in input_curves]

short_crvs = []
long_crvs = []

if input_curves:
    limit = sum(lengths) / len(lengths)

    for crv, length in zip(input_curves, lengths):
        if length < limit:
            short_crvs.append(crv)
        else:
            long_crvs.append(crv)

    difference = abs(len(long_crvs) - len(short_crvs))

    if difference % 2 == 0 and short_crvs:
        short_crvs.pop()

curves = long_crvs + short_crvs

upper_crv = short_crvs[-1] if short_crvs else None
lower_crv = get_left_segment(long_crvs[-1]) if long_crvs else None
# lower_crv = long_crvs[-1].DuplicateSegments()[0]
# ---------- end py3 ----------

# ----
# bridging start from taller wall
number_slider_2 = Slider(10, range=0..100)
neg = Negative(Value=number_slider_2)
vec = VectorXYZ(XComponent=0, YComponent=neg, ZComponent=layer_height)  # -> Vector, Length
move = Move(Geometry=py3.upper_crv, Motion=vec.Vector)  # -> Geometry, Transform
flip = FlipCurve(Curve=move.Geometry)  # -> Curve, Flag

# ----
# bridging start from shorter wall
number_slider_3 = Slider(10, range=0..100)
neg_2 = Negative(Value=number_slider_3)
vec_2 = VectorXYZ(XComponent=neg_2, YComponent=0, ZComponent=layer_height)  # -> Vector, Length
move_2 = Move(Geometry=py3.lower_crv, Motion=vec_2.Vector)  # -> Geometry, Transform
flip_2 = FlipCurve(Curve=move_2.Geometry)  # -> Curve, Flag

# ----
# fillet the corner
number_slider_4 = Slider(25, range=0..100)
fillet = Fillet(Curve=py3.curves, Radius=number_slider_4)
clean = CleanTree(RemoveNulls=True, RemoveInvalid=True, RemoveEmpty=False, Tree=fillet)
replace = ReplaceItems(List=py3.curves, Item=clean, Indices="0", Wrap=False)

stack = StackTrees(Data0=flip.Curve, Data1=flip_2.Curve, Reduce=True)

len = Length(Curve=replace)
sort = SortList(Keys=len, ValuesA=replace)  # -> Keys, ValuesA
item_2 = ListItem(List=sort.Keys, Index=0, Wrap=True)
smaller = SmallerThan(FirstNumber=replace, SecondNumber=expr("x+1", item_2))  # -> SmallerThan, OrEqualTo
dispatch = Dispatch(List=replace, DispatchPattern=smaller.OrEqualTo)  # -> ListA, ListB
crv = Curve(dispatch.ListA)
flip_3 = FlipCurve(Curve=crv)  # -> Curve, Flag
weave_2 = Weave(Pattern=smaller.OrEqualTo, Stream0=dispatch.ListB, Stream1=flip_3.Curve, NullGaps=False)

dispatch_2 = Dispatch(List=weave_2, DispatchPattern=[True, False])  # -> ListA, ListB
flip_4 = FlipCurve(Curve=dispatch_2.ListA)  # -> Curve, Flag
weave_3 = Weave(Pattern=[0, 1], Stream0=flip_4.Curve, Stream1=dispatch_2.ListB, NullGaps=False)
end = EndPoints(Curve=weave_3)  # -> Start, End
cull_i = CullIndex(List=end.Start, Indices="0", Wrap=True)
cull_i_2 = CullIndex(List=end.End, Indices="-1", Wrap=True)
ln = Line(StartPoint=cull_i_2, EndPoint=cull_i)
merge_3 = Merge(Data1=weave_3, Data2=ln)  # -> flatten(Result)
join_walls = JoinCurves(Curves=merge_3, Preserve=False)

# ---- group: Transition, Bridges
neg_3 = Negative(Value=Slider(80, range=0..100))
panel_7 = Panel("0")
ext_upper_crv = ExtendCurve(Curve=flip.Curve, Type=0, Start=neg_3, End=panel_7)

ext_wall_crv = ExtendCurve(Curve=join_walls, Type=0, Start=panel_7, End=neg_3)
end_2 = EndPoints(Curve=ext_wall_crv)  # -> simplify(Start), End
pt_2 = Point(end_2.End)

ext_lower_crv = ExtendCurve(Curve=move_2.Geometry, Type=0, Start=panel_7, End=neg_3)
neg_4 = Negative(Value=Slider(150, range=0..200))
vec_3 = VectorXYZ(XComponent=neg_4, YComponent=Slider(60, range=0..100), ZComponent=Slider(50, range=0..100))  # -> Vector, Length
move_3 = Move(Geometry=pt_2, Motion=vec_3.Vector)  # -> Geometry, Transform

bridge_spacing = Slider(52, range=0..100)
vec_4 = VectorXYZ(XComponent=Slider(20, range=0..100), YComponent=Slider(30, range=0..100), ZComponent=Slider(20, range=0..100))  # -> Vector, Length
panel_8 = Panel("""0
1
2""")

divlength = DivideLength(Curve=ext_upper_crv, Length=bridge_spacing)  # -> Points, Tangents, Parameters
move_4 = Move(Geometry=divlength.Points, Motion=vec_4.Vector)  # -> Geometry, Transform
divlength_2 = DivideLength(Curve=ext_lower_crv, Length=bridge_spacing)  # -> reverse(Points), Tangents, Parameters

item_3 = ListItem(List=divlength_2.Points, Index=0, Wrap=True)

weave_4 = Weave(Pattern=panel_8, Stream0=divlength_2.Points, Stream1=divlength.Points, Stream2=move_4.Geometry, NullGaps=False)
points = PointList(Points=weave_4, Size=15)

# ---- group: Transition, Bridges / Bridges
pline = PolyLine(Vertices=weave_4, Closed=False)

# ---- group: Transition, Bridges (continued)
stack_2 = StackTrees(Data0=pt_2, Data1=move_3.Geometry, Data2=item_3, Reduce=True)  # -> flatten(Tree)
pline_2 = PolyLine(Vertices=stack_2, Closed=False)

# ---- group: Transition, Bridges / Wall + Transition
join_2 = JoinCurves(Curves=flatten([pline_2, ext_wall_crv]), Preserve=False)

# ---- group: Transition, Bridges (continued)
join_3 = JoinCurves(Curves=flatten([join_2, pline]), Preserve=False)

# ---- group: Exit path
enter_length = Slider(100, range=0..100)
exit_length = Slider(200, range=0..300)
ext = ExtendCurve(Curve=join_3, Type=0, Start=enter_length, End=exit_length)
end_3 = EndPoints(Curve=ext)  # -> Start, End
vec_5 = VectorXYZ(XComponent=Slider(10, range=0..1000), YComponent=0, ZComponent=0)  # -> Vector, Length
line_2 = LineSDL(Start=end_3.End, Direction=vec_5.Vector, Length=vec_5.Vector)
join_4 = JoinCurves(Curves=flatten([ext, line_2]), Preserve=False)
crv_bridging = Curve(join_4)

# ----
# To Printing Bed
number_slider_5 = Slider(400, range=0..1000)
vec_6 = VectorXYZ(XComponent=number_slider_5, YComponent=Slider(-100, range=-1000..500), ZComponent="32")  # -> Vector, Length
move_5 = Move(Geometry=crv_bridging, Motion=vec_6.Vector)  # -> Geometry, Transform
explode = Explode(Curve=move_5.Geometry, Recursive=True)  # -> Segments, Vertices

# ----
# insert pt, planes for round corner
explode_2 = Explode(Curve=move_5.Geometry, Recursive=True)  # -> Segments, Vertices
explode_3 = Explode(Curve=move_5.Geometry, Recursive=invert(True))  # -> Segments, Vertices
item_4 = ListItem(List=explode_3.Vertices, Index=0, Wrap=True)  # -> Item, Item1, Item2
pdecon = Deconstruct(Point=item_4.Item1)  # -> XComponent, YComponent, ZComponent
pdecon_2 = Deconstruct(Point=item_4.Item2)  # -> XComponent, YComponent, ZComponent
panel_10 = Panel("""3
7
11
15
19
23
27
31""")
lng = ListLength(List=panel_10)
series_3 = Series(Start=pdecon.ZComponent, Step=layer_height, Count=lng)
pt_3 = ConstructPoint(XCoordinate=pdecon_2.XComponent, YCoordinate=pdecon.YComponent, ZCoordinate=series_3)
ins = InsertItems(List=explode_2.Vertices, Item=pt_3, Indices=panel_10, Wrap=True)
xy = XYPlane(Origin=ins)
points_2 = PointList(Points=explode_2.Vertices, Size=10)
pline_3 = PolyLine(Vertices=ins, Closed=False)

meshpipe = MeshPipe(Curve=pline_3, Radius=expr("x/2", layer_height), Sides=6, Tolerance=10, Ending=0)
cull_i_3 = CullIndex(List=xy, Indices="-1", Wrap=True)
explode_4 = Explode(Curve=pline_3, Recursive=True)  # -> Segments, Vertices
stack_3 = StackTrees(Data0=explode_4.Segments, Data1=cull_i_3, Reduce=True)

# ----
# Generate URscript
# Different velocities depend on vector
# Add a transition plane
pln = Plane(xy)
panel_11 = Panel("{0, 0, 0}")
v_h_m_s = Slider(0.03, range=0..1)
a_m_s = Slider(0.1, range=0..1)
v_d_m_s = Slider(0.2, range=0..1)
v_u_m_s = Slider(0.007, range=0..1)
plane_tcp_to_urscript = Python3Script(
    planes=pln,
    radius=Slider(12, range=0..200),
    acceleration=a_m_s,
    velocity_normal=v_h_m_s,
    velocity_fast=v_d_m_s,
    velocity_slow=v_u_m_s,
    fast_id=merge_2,
    slow_id=series)  # -> out, script; inputs planes: list of Plane, tcp_measured: Point3d, radius: Double, acceleration: Double, velocity_normal: Double, velocity_fast: Double, velocity_slow: Double, velocity_a: Double, fast_id: list of Int32, slow_id: list of Int32, velocity_a_id: list of Int32
# ---------- plane_tcp_to_urscript: Python ----------
from imp import reload
import sys
import math as m
import Rhino.Geometry as rg

sys.path.append(r"C:\Users\user\github\F3DP\01 tamplate\02_RoboticDrawing\src")

import simple_ur_script as ur
import utils
import simple_comm as com

reload(ur)
reload(utils)
reload(com)


def as_list(x):
    if x is None:
        return []
    return list(x) if hasattr(x, "__iter__") else [x]


def get_speed(i):
    if i in as_list(velocity_a_id):
        return velocity_a
    if i in as_list(fast_id):
        return velocity_fast
    if i in as_list(slow_id):
        return velocity_slow
    return velocity_normal


def interpolate_plane(a, b, origin, t):
    axis = rg.Vector3d.CrossProduct(a.ZAxis, b.ZAxis)
    angle = rg.Vector3d.VectorAngle(a.ZAxis, b.ZAxis)
    x, y = rg.Vector3d(a.XAxis), rg.Vector3d(a.YAxis)

    if axis.Unitize():
        rot = rg.Transform.Rotation(angle * t, axis, rg.Point3d.Origin)
        x.Transform(rot)
        y.Transform(rot)

    return rg.Plane(origin, x, y)


transition_ratio = 0.3
angle_tolerance = m.radians(1)
script = ""

if tcp_measured is not None:
    script += ur.set_tcp_by_angles(
        tcp_measured.X, tcp_measured.Y, tcp_measured.Z,
        m.radians(-90), m.radians(-90), 0
    )

blend_radii = utils.calculate_blend_radius(planes, radius)

for i, plane in enumerate(planes):
    speed = get_speed(i)

    if i == 0 or i == len(planes) - 1:
        script += ur.move_l_blend(
            plane, acceleration, speed, blend_radii[i]
        )
        continue

    prev = planes[i - 1]
    angle = rg.Vector3d.VectorAngle(prev.ZAxis, plane.ZAxis)

    if angle > angle_tolerance:
        next_plane = planes[i + 1]
        transition = rg.Plane(plane.Origin, prev.XAxis, prev.YAxis)

        script += ur.move_l_blend(
            transition, acceleration, speed, 0
        )

        origin = plane.Origin + (
            next_plane.Origin - plane.Origin
        ) * transition_ratio

        smooth_plane = interpolate_plane(
            transition, plane, origin, 1.0
        )

        dist = transition.Origin.DistanceTo(smooth_plane.Origin)
        blend = min(abs(radius), dist * 0.4)

        script += ur.move_l_blend(
            smooth_plane, acceleration, speed, blend
        )

    else:
        script += ur.move_l_blend(
            plane, acceleration, speed, blend_radii[i]
        )

script = com.concatenate_script(script)
# ---------- end plane_tcp_to_urscript ----------
panel_12 = Panel(plane_tcp_to_urscript.script)

# ---- group: Robot Simulation / URscript to Simulation
py3_2 = Python3Script(URScript=panel_12)  # -> out, planes, speeds, blend_radii; inputs URScript: String
# ---------- py3_2: Python ----------
import Rhino.Geometry as rg
import re
import math


planes = []
speeds = []
blend_radii = []

pattern = (
    r"movel\s*\(\s*p\[\s*"
    r"([-\d.]+)\s*,\s*([-\d.]+)\s*,\s*([-\d.]+)\s*,\s*"
    r"([-\d.]+)\s*,\s*([-\d.]+)\s*,\s*([-\d.]+)\s*\]"
    r".*?v\s*=\s*([-\d.]+).*?r\s*=\s*([-\d.]+)"
)

for value in re.findall(pattern, URScript):
    x, y, z, rx, ry, rz, speed, radius = map(float, value)

    # UR position: metre → Rhino millimetre
    origin = rg.Point3d(x * 1000, y * 1000, z * 1000)

    # UR rotation vector → axis-angle rotation
    rot_vec = rg.Vector3d(rx, ry, rz)
    angle = rot_vec.Length

    plane = rg.Plane.WorldXY
    plane.Origin = origin

    if angle > 1e-9:
        axis = rg.Vector3d(rot_vec)
        axis.Unitize()

        rotation = rg.Transform.Rotation(
            angle,
            axis,
            rg.Point3d.Origin
        )

        x_axis = rg.Vector3d.XAxis
        y_axis = rg.Vector3d.YAxis
        x_axis.Transform(rotation)
        y_axis.Transform(rotation)

        plane = rg.Plane(origin, x_axis, y_axis)

    planes.append(plane)
    speeds.append(speed * 1000)
    blend_radii.append(radius * 1000)
# ---------- end py3_2 ----------
panel_13 = Panel(py3_2.speeds)
panel_14 = Panel(py3_2.blend_radii)
pln_2 = Plane(py3_2.planes)

# ----
pline_4 = PolyLine(Vertices=pln_2, Closed=False)
preview = CustomPreview(Geometry=meshpipe, Material=ColourSwatch(SwatchColor=RGB(255, 249, 217)))
item_5 = ListItem(List=stack_3, Index=increment.Output, Wrap=True)
preview_2 = CustomPreview(Geometry=item_5, Material=ColourSwatch(SwatchColor=RGB(255, 255, 255)))
points_3 = PointList(Points=xy, Size=10)

# ---- group: Send UR script to Robot!
py3_3 = Python3Script(script=plane_tcp_to_urscript.script, ip_address="192.168.10.10", send=Button())  # -> out, a; inputs script: String, ip_address: String, send: Boolean
# ---------- py3_3: Python ----------
import simple_comm as com

if send:
    com.send_script(script,ip_address)
# ---------- end py3_3 ----------

# ----
item_6 = ListItem(List=pln, Index=Slider(36, range=0..100), Wrap=True)
item_7 = ListItem(List=pln, Index=series_2, Wrap=True)

lng_2 = ListLength(List=pln)
explode_5 = Explode(Recursive=True)  # -> Segments, Vertices
split = TextSplit(Text=panel_12, Separators=",")
series_4 = Series(Start=Slider(7, range=0..10), Step=Slider(8, range=0..10), Count=lng_2)
increment_2 = Increment(BeginningNumber=Slider(92, range=0..115), StepSize=1, currentValue=114, increment=1, oldStart=92)  # -> Output, Item
item_8 = ListItem(List=split, Index=series_4, Wrap=True)
stack_4 = StackTrees(Data0=pln, Data1=item_8, Data2=explode_5.Segments, Reduce=True)
tag = TextTag(Location=pln, Text=item_8, Colour=ColourSwatch(SwatchColor=RGB(255, 255, 255)))
item_9 = ListItem(List=stack_4, Index=increment_2.Output, Wrap=True)
panel_15 = Panel(item_8)

shift = ShiftList(List=pln, Shift=1, Wrap=invert(True))
cull_i_4 = CullIndex(List=pln, Indices="-1", Wrap=True)
ln_2 = Line(StartPoint=cull_i_4, EndPoint=shift)

# ---- group: Robot Simulation
list = RobotsLibrary({"UR3e", "UR5e", "UR10e", "UR16e", "UR3", "UR5", "UR10", "UR20", "UR30"}, selected="UR10", Type=0)
pflip = FlipPlane(Plane=pln_tcp, ReverseX=False, ReverseY=False, SwapAxes=True)

# ---- group: Robot Simulation / tool or end effector
tool_name = Panel("extruder")
weight = Panel("2.0")
createtool = CreateTool(Name=tool_name, TCP=pflip, Weight=weight, Mesh=tool)  # -> Tool, TCP

# ---- group: Robot Simulation / create targets
cut_speed_mm_s = Panel("100.0")
list_2 = ValueList({"Joint", "Linear"}, selected="Linear")
blending_radius_mm = Panel("10.0")
createtarget = CreateTarget(Plane=pln_2, Motion=list_2, Tool=createtool.Tool, Speed=panel_13, Zone=panel_14, IsCartesian=True)

# ---- group: Robot Simulation / robot
loadrobotsystem = LoadRobotSystem(Name=list, Base=PlaneXY(0, 0, 0))

# ---- group: Robot Simulation / turn on and off the tool
approach_speed = Panel("250.0")
do_digital_output_port = Panel("0")
_1_true_open = Panel("1")
stop_zone = Panel("0")
_0_false_close = Panel("0")
item_10 = ListItem(List=createtarget, Index=0, Wrap=True)  # -> Item1, Item
setdo = SetDO(DO=do_digital_output_port, Value=_1_true_open)
setdo_2 = SetDO(DO=do_digital_output_port, Value=_0_false_close)
speed = SpeedParameter(approach_speed)
zone = ZoneParameter(stop_zone)
createtarget_2 = CreateTarget(Target=item_10.Item, Speed=speed, Zone=zone, Command=setdo, IsCartesian=True)
createtarget_3 = CreateTarget(Target=item_10.Item1, Zone=zone, Command=setdo_2, IsCartesian=True)
merge_4 = Merge(Data1=createtarget_2, Data2=createtarget_3)
panel_16 = Panel("""0
-2""")
replace_2 = ReplaceItems(List=createtarget, Item=merge_4, Indices=panel_16, Wrap=True)

# ---- group: Robot Simulation / create program
home_position = Panel("0, -pi/2, -pi/2, -pi/2, -pi/2, -pi/2")
blending_radius_mm_2 = Panel("20")
createtarget_4 = CreateTarget(Joints=home_position, Tool=createtool.Tool, Speed=speed, Zone=blending_radius_mm_2, IsCartesian=False)
panel_17 = Panel("""0
-1""")
program_name = Panel("PU_Extrusion")
ins_2 = InsertItems(List=replace_2, Item=createtarget_4, Indices=panel_17, Wrap=True)
createprogram = CreateProgram(Name=program_name, RobotSystem=loadrobotsystem, Targets=ins_2, StepSize=1)  # -> Program, Code, Duration, Warnings, Errors

# ---- group: Robot Simulation / preview
programsimulation = ProgramSimulation(Program=createprogram.Program, Time=Slider(0.43072, range=0..1), Normalized=True)  # -> SystemMeshes, JointRotations, Plane, Index, Time, Program, Errors
preview_3 = CustomPreview(
    Geometry=programsimulation.SystemMeshes,
    Material={diffuse=RGB(192, 192, 255), emission=RGB(142, 142, 255), shine=1, specular=RGB(255, 255, 255), transparency=0.2})
expression = Expression(x=programsimulation.Time, Expression="x/60")  # -> flatten(R)
simpletrail = SimpleTrail(Program=programsimulation.Program, Length=500, MechanicalGroup=0)
time = Panel(programsimulation.Time)
time_min = Panel(expression)

# ---- group: Robot Simulation / save program to file
panel_18 = Panel("D:\living in Switzerland\ETH\T3_Foam Printing\Print test\0708\URScript")
save_program = SaveProgram(Program=createprogram.Program, Folder=panel_18)

# ---- group: Robot Simulation (continued)
robot_program = Panel(createprogram.Code)
